# Grasshopper definition TEST - grid & shading def.gh (Grasshopper 0.9.76)
# plug-ins: ShadingDevice, IvyGh

d0_rw = Slider(0.5, range=0.4..0.6)
d1_rh = Slider(0.28, range=0.26..0.3)

r = Number(Tree({1}: [0.5, 0.4, 0.6], {2}: [0.26, 0.28, 0.3]))
txt = Text(["rw", "rh"])
panel = Panel(r)
panel_2 = Panel(txt)
grid = CreateGrid(InputRange=panel, Labels=panel_2)  # -> GridInfo, Grid
slider = GridSlider(grid=grid.Grid, D0=d0_rw, D1=d1_rh)  # -> Info, ActivePoint, ActiveCell, GridNodes
panel_3 = Panel(grid.GridInfo)

d0_a1 = Slider(0, range=-25..25)
d1_a2 = Slider(12.5, range=-25..50)

A = Number(Tree({1}: [-25, 0, 25], {2}: [-25, 0, 50]))
txt_2 = Text(["A1", "A2"])
panel_4 = Panel(A)
panel_5 = Panel(txt_2)
grid_2 = CreateGrid(InputRange=panel_4, Labels=panel_5)  # -> GridInfo, Grid
slider_2 = GridSlider(grid=grid_2.Grid, D0=d0_a1, D1=d1_a2)  # -> Info, ActivePoint, ActiveCell, GridNodes
panel_6 = Panel(slider_2.Info)

g1xg2 = CartesianProduct(FirstGrid=grid.Grid, SecondGrid=grid_2.Grid)  # -> Info, CartesianProduct
t1xt2 = CartesianProductOfTuples(FirstTuple=slider.ActivePoint, SecondTuple=slider_2.ActivePoint)
point = PointOnGrid(Grid=g1xg2.CartesianProduct, PointCoordinates=t1xt2)  # -> PointCoordinates, CellNumber

normalize = Normalize(Grid=g1xg2.CartesianProduct)  # -> Info, Grid
panel_7 = Panel("subdir")

# ---- group: Number of Faces
u1 = Slider(6, range=4..20)
u2 = Slider(12, range=4..20)
V = Slider(10, range=4..20)

# ----
w = Slider(0.6, range=0..1)
l = Slider(0.6, range=0.1..0.8)
h = Slider(0.25, range=0.1..0.8)

panel_8 = Panel(g1xg2.Info)
lanch = Button()
multiple_definition = CSharpScript(
    grid_topo=grid.Grid,
    w=w,
    l=l,
    h=h,
    U1=u1,
    U2=u2,
    V=V,
    Reference="Z:\Public\GitHub\Ivy\src\IvyCore\bin\Debug\IvyCore.dll")  # -> out, N, M, A1, A2, BC; inputs w: Double, l: Double, h: Double, U1: Int32, U2: Int32, V: Int32
# ---------- multiple_definition: C# ----------
    var topoGrid = (Grid) grid_topo;

    //var range_rw = new double[3]{0.4, 0.5, 0.6};
    //var range_rh = new double[3]{0.26, 0.28, 0.3};


    //var data = new double[2][]{range_rw, range_rh};

    //Grid topoGrid = new Grid(data);
    Print("" + topoGrid.NodeCount);

    var meshProp = new int[3]{U1,U2,V};

    Mesh m;
    int[][] a;
    int[] b;
    double rw, rh;

    var n_list = new List<Node>();
    var m_list = new List<Mesh>();
    var a1_list = new List<int[]>();
    var a2_list = new List<int[]>();
    var bc_list = new List<int[]>();

    for (int i = 0; i < topoGrid.NodeCount; i++)
    {
      var topoNode = topoGrid.Nodes[i];
      rw = topoNode[0];
      rh = topoNode[1];
      Print(rw + "," + rh);

      ShadingDevice(w, l, h, rw, rh, meshProp, out m, out a, out b);


      var a1 = new Line(m.Vertices[a[0][0]], m.Vertices[a[0][1]]);
      var a2 = new Line(m.Vertices[a[1][0]], m.Vertices[a[1][1]]);
      var bc = m.Vertices[b[0]];

      n_list.Add(topoNode);
      m_list.Add(m);
      a1_list.Add(a[0]);
      a2_list.Add(a[1]);
      bc_list.Add(b);
    }

    N = n_list;
    M = m_list;
    A1 = a1_list;
    A2 = a2_list;
    BC = bc_list;
# ---------- multiple_definition: C# additional code ----------
  public void ShadingDevice(double w, double l, double h, double rw, double rh, int[] meshProp, out Mesh mesh, out int[][] A, out int[] BC)
  {
    // U1, U2, V = number of FACES in each direction
    // U1+1, U2+1, V+1 => number of VERTICIES in each direction
    var U1 = meshProp[0];
    var U2 = meshProp[1];
    var V = meshProp[2];


    Surface s1, s2;
    GetSurfaces(w, l, h, rw, rh, out s1, out s2);

    var P1 = GetUVGrid(s1, U1 + 1, V + 1);
    var P2 = GetUVGrid(s2, U2 + 1, V + 1);
    mesh = GetUVGridMerge(P1, P2);

    /*
    Print("edede");
    mesh = new Mesh();
    A = new int[2][];
    BC = new int[1];
    return;
*/

    // Actuator 1
    var a1_0 = 0;
    var a1_1 = V * ((U1 + 1) + (U2 + 1) - 1) + U1;
    var A1 = new int[2]{a1_0, a1_1};

    // Actuator 2
    var a2_0 = a1_1 - U1;
    var a2_1 = a1_0 + U1;
    var A2 = new int[2]{a2_0, a2_1};

    // Actuators array
    A = new int[2][]{A1,A2};

    // Boudary condition
    var bc = (V / 2) * ((U1 + 1) + (U2 + 1) - 1) + U1 / 2;
    BC = new int[1]{bc};
  }

  /// <summary>
  /// Define the two surfaces that build up a shading device.
  /// </summary>
  /// <param name="w"></param>
  /// <param name="l"></param>
  /// <param name="h"></param>
  /// <param name="rw"></param>
  /// <param name="rh"></param>
  /// <param name="S1"></param>
  /// <param name="S2"></param>
  /// <returns></returns>
  public void GetSurfaces(double w, double l, double h, double rw, double rh, out Surface S1, out Surface S2)
  {
    Point3d p0,p1,p2;

    var sweep = new Rhino.Geometry.SweepOneRail();

    /*
    Print("sdsmdlksmlkd");
    S1 = new Surface();
    S2 = new Surface();
    return;
*/

    // Create S1 cross section crv
    p0 = new Point3d(-w / 2, 0, 0);
    p1 = new Point3d(0, rw - Math.Sqrt(rw * rw - w * w / 4), 0);
    p2 = new Point3d(+w / 2, 0, 0);
    var cs1 = new Arc(p0, p1, p2);
    var cs2 = new Arc(p0, p1, p2);

    // Create S1 rail crv
    var alpha = Math.Asin(h / rh); // arc angle
    p0 = new Point3d(-w / 2, 0, 0);
    p1 = new Point3d(-w / 2, rh * (1 - Math.Cos(alpha / 2)), rh * Math.Sin(alpha / 2));
    p2 = new Point3d(-w / 2, rh * (1 - Math.Cos(alpha)), h);
    var r1 = new Arc(p0, p1, p2);

    // Create S1 by sweep
    S1 = sweep.PerformSweep(r1.ToNurbsCurve(), cs1.ToNurbsCurve())[0].Surfaces[0];

    // Create S2 cross section crv
    var axis = new Vector3d(1, 0, 0);
    var center = new Point3d(0, rh, 0);
    var xform = Transform.Rotation(-alpha, axis, center);
    cs2.Transform(xform);

    // Create S1 rail crv
    var dir = new Vector3d(0, 1, 0);
    var r2 = new Line(p2, p2 + l * dir);

    // Create S2 by sweep
    S2 = sweep.PerformSweep(r2.ToNurbsCurve(), cs2.ToNurbsCurve())[0].Surfaces[0];
  }

  /// <summary>
  /// Get a grid of points on a surface along U and V.
  /// </summary>
  /// <param name="S">Input surface.</param>
  /// <param name="nu">Number of points in U direction.</param>
  /// <param name="nv">Number of points un V direction.</param>
  /// <returns>A 2 dimensionnal array of points P[iv][iu] of dimension nu*nv.</returns>
  public Point3d[][] GetUVGrid(Surface S, int nu, int nv)
  {
    var Iu = S.Domain(0);
    var Iv = S.Domain(1);

    int index;
    double u,v,tu,tv;

    var pts = new Point3d[nv][];

    // Create a Grid of points
    for (int iv = 0; iv < nv; iv++)
    {
      pts[iv] = new Point3d[nu];
      tv = (double) iv / (nv - 1);
      v = (1 - tv) * Iv.T0 + tv * Iv.T1;
      for (int iu = 0; iu < nu; iu++)
      {
        index = iu + nu * iv;
        tu = (double) iu / (nu - 1);
        u = (1 - tu) * Iu.T0 + tu * Iu.T1;
        var pt = S.PointAt(u, v);
        pts[iv][iu] = pt;
      }
    }
    return pts;
  }

  /// <summary>
  /// Merge 2 compatible grids of points along their U dilmension.
  /// </summary>
  /// <param name="P1">The first grid of points of length nv x nu1.</param>
  /// <param name="P2">The second grid of points of length nv x nu2.</param>
  /// <returns>A mesh.</returns>
  public Mesh GetUVGridMerge(Point3d[][] P1, Point3d[][] P2)
  {
    Mesh mesh = new Mesh();
    //pts = new List<Point3d>();

    int nu1 = P1[0].Length;
    int nv1 = P1.Length;

    int nu2 = P2[0].Length;
    int nv2 = P2.Length;

    // Merge grid along u (nv1 = nv2)
    // remove the duplicates in line iu1 = nu1-1 | iu2 = 0
    int nv = nv1;
    int nu = nu1 + nu2 - 1;
    for (int iv = 0; iv < nv; iv++)
    {
      // Add P1 points
      for (int iu1 = 0; iu1 < nu1; iu1++)
      {
        //index = iu1 + nu * iv;
        mesh.Vertices.Add(P1[iv][iu1]);
        //pts.Add(P1[iv][iu1]);
      }

      // Add P2 points
      for (int iu2 = 1; iu2 < nu2; iu2++)
      {
        //index = (nu1 - 1) + (iu2 - 1) + nu * iv;
        mesh.Vertices.Add(P2[iv][iu2]);
        //pts.Add(P2[iv][iu2]);
      }
    }

    // create faces
    for (int iv = 0; iv < nv - 1; iv++)
    {
      for (int iu = 0; iu < nu - 1; iu++)
      {
        int A = iu + nu * iv;
        int B = A + 1;
        int C = iu + 1 + nu * (iv + 1);
        int D = C - 1;
        mesh.Faces.AddFace(A, B, C, D);
        //Print(String.Format("({0},{1},{2},{3})", A, B, C, D));
      }
    }

    return mesh;
  }
# ---------- end multiple_definition ----------
lng = ListLength(List=multiple_definition.M)
node = Node(multiple_definition.N)
lanch_2 = Button()
test_inp = FilePath("C:\Users\Lionel\Documents\Abaqus\BeamNShell\test.inp")
workingdir = FilePath("C:\Users\Lionel\Documents\Abaqus\WorkingDir\help.txt.txt")
abaqus_inp_file = RunPythonScriptFile(path_to_inp=test_inp, launch=lanch, TooltipTextOverride="Launch a structural analysis with gRIDshell")  # -> out, res; inputs vertices: list of Point3d, faces: tree of Int32, A1: list of Int32, A2: list of Int32, BC: list of Int32, launch: Boolean
# ---------- abaqus_inp_file: Python ----------
    string dir = System.IO.Path.GetDirectoryName(path_to_inp.ToString());
    string filename = System.IO.Path.GetFileName(path_to_inp.ToString());

    Print("WORKING DIR : " + dir);
    Print("SCRIPT FILE : " + filename);

    // actuator length (in m)
    double sec = Math.PI * Math.Pow(0.06, 2);
    double l1 = vertices[A1[0]].DistanceTo(vertices[A1[1]]);
    double l2 = vertices[A2[0]].DistanceTo(vertices[A2[1]]);

    // coefficient of thermal expansion
    double aT1 = 1e-3 / l1;
    double aT2 = 1e-3 / l2;

    double aT = 0.0001;
    //aT1 = aT;
    //aT2 = aT;

    List<string> s = new List<String>();

    var heading = GetHeading();
    var nodes_shell = GetShellNodes(vertices);
    var nodes_actuator = GetActuatorNodes(vertices, A1, A2);
    var elements_shell = GetShellElements(faces);
    var elements_actuator = GetActuatorElements(vertices, faces);
    var sections = GetSections();
    var sets = GetSets(vertices, faces, A1, A2, BC);
    var ties = GetTies(vertices, faces, A1, A2);
    var materials = GetMaterials(aT1, aT2);
    var fields = GetPredefinedFields();
    var bc = GetBoudaryConditions(BC);
    var steps = GetSteps(BC);

    s.AddRange(heading);

    s.Add("**");
    s.Add("** =============================================================================");
    s.Add("** PART");
    s.Add("** =============================================================================");
    s.Add("**");
    s.Add("*Part, name=\"Part A\"");
    s.AddRange(nodes_shell);
    s.AddRange(nodes_actuator);
    s.AddRange(elements_shell);
    s.AddRange(elements_actuator);
    s.AddRange(sets);
    s.AddRange(sections);
    s.Add("*End Part");
    s.Add("**");
    s.Add("** =============================================================================");
    s.Add("** ASSEMBLY");
    s.Add("** =============================================================================");
    s.Add("**");
    s.Add("*Assembly, name=Assembly");
    s.Add("**");
    s.Add("*Instance, name=\"Instance A\", part=\"Part A\"");
    s.Add("*End Instance");
    s.Add("**");
    s.AddRange(ties);
    s.Add("*End Assembly");
    s.Add("**");
    s.Add("** =============================================================================");
    s.Add("** MATERIALS");
    s.Add("** =============================================================================");
    s.Add("**");
    s.AddRange(materials);
    s.Add("**");
    s.Add("** =============================================================================");
    s.Add("** BOUDARY CONDITIONS");
    s.Add("** =============================================================================");
    s.Add("**");
    s.AddRange(bc);
    s.Add("**");
    s.Add("** =============================================================================");
    s.Add("** STEPS");
    s.Add("** =============================================================================");
    s.Add("**");

    var path = dir + "\\" + "model.inp";
    File.WriteAllLines(path, s);
    File.Move(path, Path.ChangeExtension(path, ".inp"));

    res = nodes_shell;
# ---------- abaqus_inp_file: Python additional code ----------
  // TEXT FOR INP FILE
  public string[] GetHeading()
  {
    List<string> s = new List<string>();
    s.Add("*Heading");
    s.Add("**Author : Lionel du Peloux");
    s.Add("**email : lionel.dupeloux@gmail.com");
    s.Add("**Job name: LDP");
    s.Add("**Model name: Shape A");
    s.Add("*Preprint, echo=NO, model=NO, history=NO, contact=NO");

    return s.ToArray();
  }
  public string[] GetShellNodes(List<Point3d> vertices)
  {
    string format = "F8";
    List<string> s = new List<string>();

    s.Add("*Node, nset=\"shell\"");
    for (int i = 0; i < vertices.Count; i++)
    {
      s.Add(
        String.Format("{0,4},{1,12},{2,12},{3,12}",
        i + 1,
        vertices[i].X.ToString(format),
        vertices[i].Y.ToString(format),
        vertices[i].Z.ToString(format))
        );
    }
    return s.ToArray();
  }
  public string[] GetShellElements(DataTree<int> faces)
  {
    List<string> s = new List<string>();

    s.Add("*Element, type=S4R, elset=\"shell\"");

    for (int i = 0; i < faces.BranchCount; i++)
    {
      var list = faces.Branches[i];
      s.Add(
        String.Format("{0},{1},{2},{3},{4}",
        i + 1,
        list[0] + 1,
        list[1] + 1,
        list[2] + 1,
        list[3] + 1
        )
        );
    }
    return s.ToArray();
  }
  public string[] GetActuatorNodes(List<Point3d> vertices, List<int> A1, List<int> A2)
  {
    string format = "F6";
    List<string> s = new List<string>();

    s.Add("*Node, nset=\"A1\"");
    int n = vertices.Count;
    s.Add(
      String.Format("{0,6},{1,12},{2,12},{3,12}",
      n + 1,
      vertices[A1[0]].X.ToString(format),
      vertices[A1[0]].Y.ToString(format),
      vertices[A1[0]].Z.ToString(format))
      );
    s.Add(
      String.Format("{0,6},{1,12},{2,12},{3,12}",
      n + 2,
      vertices[A1[1]].X.ToString(format),
      vertices[A1[1]].Y.ToString(format),
      vertices[A1[1]].Z.ToString(format))
      );

    s.Add("*Node, nset=\"A2\"");
    s.Add(
      String.Format("{0,6},{1,12},{2,12},{3,12}",
      n + 3,
      vertices[A2[0]].X.ToString(format),
      vertices[A2[0]].Y.ToString(format),
      vertices[A2[0]].Z.ToString(format))
      );
    s.Add(
      String.Format("{0,6},{1,12},{2,12},{3,12}",
      n + 4,
      vertices[A2[1]].X.ToString(format),
      vertices[A2[1]].Y.ToString(format),
      vertices[A2[1]].Z.ToString(format))
      );

    return s.ToArray();
  }
  public string[] GetActuatorElements(List<Point3d> vertices, DataTree<int> faces)
  {
    List<string> s = new List<string>();

    int nv = vertices.Count;
    int nf = faces.BranchCount;

    //B31
    s.Add("*Element, type=T3D2H, elset=\"A1\"");
    s.Add(String.Format("{0,6},{1,6},{2,6}",
      nf + 1,
      nv + 1,
      nv + 2)
      );

    s.Add("*Element, type=T3D2H, elset=\"A2\"");
    s.Add(String.Format("{0,6},{1,6},{2,6}",
      nf + 2,
      nv + 3,
      nv + 4)
      );
    return s.ToArray();
  }
  public string[] GetSections()
  {
    List<string> s = new List<string>();

    // SHELL
    s.Add("*Shell Section, elset=\"shell\", material=\"shell\"");
    s.Add("0.01, 5"); // thickness, thickness integration points

    // ACTUATOR 1
    s.Add("*Solid Section, elset=\"A1\", material=\"actuator\"");
    s.Add(String.Format("{0:e2}", 5e-2 * 5e-2)); // section

    // ACTUATOR 2
    s.Add("*Solid Section, elset=\"A2\", material=\"actuator\"");
    s.Add(String.Format("{0:e2}", 5e-2 * 5e-2)); // section

    return s.ToArray();
  }
  public string[] GetSets(List<Point3d> vertices, DataTree<int> faces, List<int> A1, List<int> A2, List<int> BC)
  {
    List<string> s = new List<string>();
    int nv = vertices.Count;
    int nf = faces.BranchCount;
    int n = BC.Count;

    // ACTUATOR 1
    s.Add("*Nset, nset=\"A1-1-shell\"");
    s.Add(String.Format("{0}", A1[0] + 1));
    s.Add("*Nset, nset=\"A1-1-beam\"");
    s.Add(String.Format("{0}", nv + 1));

    s.Add("*Nset, nset=\"A1-2-shell\"");
    s.Add(String.Format("{0}", A1[1] + 1));
    s.Add("*Nset, nset=\"A1-2-beam\"");
    s.Add(String.Format("{0}", nv + 2));

    // ACTUATOR 2
    s.Add("*Nset, nset=\"A2-1-shell\"");
    s.Add(String.Format("{0}", A2[0] + 1));
    s.Add("*Nset, nset=\"A2-1-beam\"");
    s.Add(String.Format("{0}", nv + 3));

    s.Add("*Nset, nset=\"A2-2-shell\"");
    s.Add(String.Format("{0}", A2[1] + 1));
    s.Add("*Nset, nset=\"A2-2-beam\"");
    s.Add(String.Format("{0}", nv + 4));

    // BOUNDARY CONDITIONS
    int[] bc = BC.ToArray();
    for (int i = 0; i < bc.Length; i++)
    {
      bc[i] += 1;
    }
    s.Add("*Nset, nset=\"BC\"");
    s.Add(String.Join(", ", bc));

    return s.ToArray();

  }
  public string[] GetTies(List<Point3d> vertices, DataTree<int> faces, List<int> A1, List<int> A2)
  {
    List<string> s = new List<string>();
    int nv = vertices.Count;
    int nf = faces.BranchCount;

    // ACTUATOR 1
    ///*
    s.Add("*Surface, type=NODE, name=\"A1-1-shell\", internal");
    s.Add(String.Format("\"Instance A\".\"{0}\", 1.", "A1-1-shell"));
    s.Add("*Surface, type=NODE, name=\"A1-1-beam\", internal");
    s.Add(String.Format("\"Instance A\".\"{0}\", 1.", "A1-1-beam"));
    //*/
    s.Add("*Tie, name=\"A1-1\", adjust=no, no rotation");
    s.Add("\"A1-1-shell\", \"A1-1-beam\"");

    ///*
    s.Add("*Surface, type=NODE, name=\"A1-2-shell\", internal");
    s.Add(String.Format("\"Instance A\".\"{0}\", 1.", "A1-2-shell"));
    s.Add("*Surface, type=NODE, name=\"A1-2-beam\", internal");
    s.Add(String.Format("\"Instance A\".\"{0}\", 1.", "A1-2-beam"));
    //*/
    s.Add("*Tie, name=\"A1-2\", adjust=no, no rotation");
    s.Add("\"A1-2-shell\", \"A1-2-beam\"");

    // ACTUATOR 2
    ///*
    s.Add("*Surface, type=NODE, name=\"A2-1-shell\", internal");
    s.Add(String.Format("\"Instance A\".\"{0}\", 1.", "A2-1-shell"));
    s.Add("*Surface, type=NODE, name=\"A2-1-beam\", internal");
    s.Add(String.Format("\"Instance A\".\"{0}\", 1.", "A2-1-beam"));
    //*/
    s.Add("*Tie, name=\"A2-1\", adjust=no, no rotation");
    s.Add("\"A2-1-shell\", \"A2-1-beam\"");

    ///*
    s.Add("*Surface, type=NODE, name=\"A2-2-shell\", internal");
    s.Add(String.Format("\"Instance A\".\"{0}\", 1.", "A2-2-shell"));
    s.Add("*Surface, type=NODE, name=\"A2-2-beam\", internal");
    s.Add(String.Format("\"Instance A\".\"{0}\", 1.", "A2-2-beam"));
    //*/
    s.Add("*Tie, name=\"A2-2\", adjust=no, no rotation");
    s.Add("\"A2-2-shell\", \"A2-2-beam\"");

    return s.ToArray();

  }
  public string[] GetMaterials(double aT1, double aT2)
  {
    List<string> s = new List<string>();

    // SHELL
    s.Add("*Material, name=\"shell\"");
    s.Add("*Density");
    s.Add(String.Format("{0:F2},", 1));
    s.Add("*Elastic");
    s.Add(String.Format("{0:e3}, {1:F2}", 5e+09, 0.3));

    // ACTUATORS
    s.Add("*Material, name=\"actuator\"");
    s.Add("*Density");
    s.Add(String.Format("{0:F2},", 8));
    s.Add("*Elastic");
    s.Add(String.Format("{0:e3}, {1:F2}", 210e+09, 0.3));
    s.Add("*Expansion");
    s.Add(String.Format("{0:e3},", aT1));

    return s.ToArray();
  }
  public string[] GetPredefinedFields()
  {
    List<string> s = new List<string>();

    // SHELL
    s.Add("*Initial Conditions, type=Temperature");
    s.Add("\"Instance A\".\"A1\", 0.");
    s.Add("*Initial Conditions, type=Temperature");
    s.Add("\"Instance A\".\"A2\", 0.");

    return s.ToArray();
  }
  public string[] GetBoudaryConditions(List<int> BC)
  {
    List<string> s = new List<string>();

    s.Add("*Boundary");
    s.Add("\"Instance A\".\"BC\", ENCASTRE");

    return s.ToArray();
  }
  public string[] GetSteps(List<int> BC)
  {
    List<string> s = new List<string>();

    var bc = GetBoudaryConditions(BC);

    double timePeriod = 1.0;
    double incrementInitial = 0.01;
    double incrementMin = 1e-6;
    double incrementMax = 0.05;

    var ax = new double[2]{50,-50};
    var ay = new double[2]{50,-50};

    var a = new double[2, 2];

    // SHELL
    int stepCount = 1;
    for (int i = 0; i < 2; i++)
    {
      for (int j = 0; j < 2; j++)
      {
        string stepName = String.Format("A[{0},{1}]=({2:F2},{3:F2})", i, j, ax[i], ay[j]);
        s.Add("**");
        s.Add("** " + "STEP[" + stepCount + "] : " + stepName);
        s.Add("**");

        //s.Add("*Step, name=\"STEP" + stepCount + "\", nlgeom = YES");
        //s.Add(String.Format("*Step, name=\"({0},{1})\", nlgeom = YES", i, j));
        s.Add(String.Format("*Step, name=\"({0:F0},{1:F0})\", nlgeom = YES", ax[i], ay[j]));
        s.Add("*Static");
        s.Add(String.Format("{0}, {1}, {2}, {3}", incrementInitial, timePeriod, incrementMin, incrementMax));
        //s.AddRange(bc);


        s.Add("*Temperature, op=NEW");
        s.Add("*Temperature, op=NEW");
        s.Add("*Temperature, op=NEW");
        s.Add(String.Format("\"Instance A\".\"A1\", {0:F6}", ax[i]));
        s.Add("*Temperature, op=NEW");
        s.Add(String.Format("\"Instance A\".\"A2\", {0:F6}", ay[j]));

        s.Add("*Restart, write, frequency=0");
        s.Add("*Output, field, variable=PRESELECT");
        s.Add("*Output, history, variable=PRESELECT");

        s.Add("*End Step");
        stepCount++;
      }
    }
    return s.ToArray();
  }
# ---------- end abaqus_inp_file ----------
abaqus_inp_file_2 = RunPythonScriptFile(
    path_wd=workingdir,
    grid_actu=grid_2.Grid,
    N=multiple_definition.N,
    M=multiple_definition.M,
    BC=multiple_definition.BC,
    launch=lanch_2,
    TooltipTextOverride="Launch a structural analysis with gRIDshell",
    Reference="Z:\PUBLIC\GITHUB\IVY\SRC\IVYCORE\BIN\DEBUG\IvyCore.dll")  # -> out, res; inputs N: list, M: list of Mesh, BC: list, A: list, launch: Boolean
# ---------- abaqus_inp_file_2: Python ----------
    string workingDir = System.IO.Path.GetDirectoryName(path_wd.ToString());
    string filename = System.IO.Path.GetFileName(path_wd.ToString());

    var actuGrid = (Grid) grid_actu;

    // DELETE ALL SUBDIRS FROM WKDIR
    foreach (string path in Directory.GetDirectories(workingDir))
    {
      Directory.Delete(path, true);
    }

    for (int i = 0; i < N.Count; i++)
    {
      var folderPath = System.IO.Path.Combine(workingDir, "" + i);
      System.IO.Directory.CreateDirectory(folderPath);
      Print("" + i);
    }

    Print("WORKING DIR : " + workingDir);
    Print("SCRIPT FILE : " + filename);


    // actuator length (in m)
    //double sec = Math.PI * Math.Pow(0.06, 2);
    //double l1 = vertices[A1[0]].DistanceTo(vertices[A1[1]]);
    //double l2 = vertices[A2[0]].DistanceTo(vertices[A2[1]]);

    // coefficient of thermal expansion
    //double aT1 = 1e-3 / l1;
    //double aT2 = 1e-3 / l2;

    //double aT = 0.0001;
    //aT1 = aT;
    //aT2 = aT;

    List<string> s = new List<String>();


    s.Add("**");
    s.Add("** =============================================================================");
    s.Add("** PART");
    s.Add("** =============================================================================");
    s.Add("**");
    s.Add("*Part, name=\"Part A\"");


    //var path = workingDir + "\\" + "model.inp";
    //File.WriteAllLines(path, s);
    //File.Move(path, Path.ChangeExtension(path, ".inp"));

    res = s;
# ---------- end abaqus_inp_file_2 ----------
panel_9 = Panel(abaqus_inp_file_2.out)
list = RunPythonScriptFile(
    list=multiple_definition.A1,
    TooltipTextOverride="Launch a structural analysis with gRIDshell",
    Reference="Z:\PUBLIC\GITHUB\IVY\SRC\IVYCORE\BIN\DEBUG\IvyCore.dll")  # -> simplify(res)
# ---------- list: Python ----------
    res = (int[]) list;
# ---------- end list ----------
list_2 = RunPythonScriptFile(
    list=multiple_definition.A2,
    TooltipTextOverride="Launch a structural analysis with gRIDshell",
    Reference="Z:\PUBLIC\GITHUB\IVY\SRC\IVYCORE\BIN\DEBUG\IvyCore.dll")  # -> simplify(res); same code as list
list_3 = RunPythonScriptFile(
    list=multiple_definition.BC,
    TooltipTextOverride="Launch a structural analysis with gRIDshell",
    Reference="Z:\PUBLIC\GITHUB\IVY\SRC\IVYCORE\BIN\DEBUG\IvyCore.dll")  # -> simplify(res); same code as list
builder = AbaqusBuilder(
    WorkingDirectory=workingdir,
    ShapeGrid=grid.Grid,
    ActuationGrid=grid_2.Grid,
    Node=node,
    ShellMesh=multiple_definition.M,
    FirstActuator=list,
    SecondActuator=list_2,
    BoundaryCondition=list_3)
panel_10 = Panel(builder)
panel_11 = Panel(normalize.Info)
panel_12 = Panel(abaqus_inp_file.out)
lanch_3 = Button()
a1 = Panel(list)
abaqus_py_file = RunPythonScriptFile(path_to_py=test_inp, launch=lanch_3, TooltipTextOverride="Launch a structural analysis with gRIDshell")  # -> out, path_to_script; inputs launch: Boolean; disabled
# ---------- abaqus_py_file: Python ----------
    string dir = System.IO.Path.GetDirectoryName(path_to_py.ToString());
    string filename = System.IO.Path.GetFileName(path_to_py.ToString());

    Print("WORKING DIR : " + dir);
    Print("SCRIPT FILE : " + filename);



    List<string> s = new List<String>();

    var heading = GetHeading(dir);
    var fields = GetPredefinedFields();
    var steps = GetSteps();
    var job = GetJob();
    var files = GetAbaqusFiles(dir);

    s.AddRange(heading);


    s.Add(" ");
    s.Add("# =============================================================================");
    s.Add("# LOAD .INP");
    s.Add("# =============================================================================");
    s.Add(" ");
    s.Add("mdb.ModelFromInputFile(inputFileName='" + dir + "\\" + "model.inp" + "'" + ", name='model')");
    s.Add("del mdb.models['Model-1']");
    s.Add(" ");
    s.Add("# =============================================================================");
    s.Add("# DEFINE STEPS");
    s.Add("# =============================================================================");
    s.Add(" ");
    s.AddRange(fields);
    s.AddRange(steps);
    s.Add(" ");
    s.Add("# =============================================================================");
    s.Add("# LAUNCH JOB");
    s.Add("# =============================================================================");
    s.Add(" ");
    s.AddRange(job);
    s.Add(" ");
    s.Add("# =============================================================================");
    s.Add("# SAVE ABAQUS FILES");
    s.Add("# =============================================================================");
    s.Add(" ");
    s.AddRange(files);

    var path = dir + "\\" + "model.py";
    File.WriteAllLines(path, s);
    File.Move(path, Path.ChangeExtension(path, ".py"));

    path_to_script = path;
    for (int i = 0; i < s.Count; i++)
    {
      Print(s[i]);
    }
# ---------- abaqus_py_file: Python additional code ----------
  // TEXT FOR INP FILE

  public string[] GetHeading(string dir)
  {
    List<string> s = new List<string>();

    // imports
    s.Add("from part import *");
    s.Add("from material import *");
    s.Add("from section import *");
    s.Add("from assembly import *");
    s.Add("from step import *");
    s.Add("from interaction import *");
    s.Add("from load import *");
    s.Add("from mesh import *");
    s.Add("from optimization import *");
    s.Add("from job import *");
    s.Add("from sketch import *");
    s.Add("from visualization import *");
    s.Add("from connectorBehavior import *");

    return s.ToArray();
  }
  public string[] GetPredefinedFields()
  {
    List<string> s = new List<string>();

    s.Add("# T1 : actuation field 1 | +1K => 1mm expansion | -1K => 1mm skrinkage");
    s.Add("# T2 : actuation field 2 | +1K => 1mm expansion | -1K => 1mm skrinkage");
    s.Add("mdb.models['model'].Temperature(" +
      "createStepName='Initial'" + ", " +
      "crossSectionDistribution=CONSTANT_THROUGH_THICKNESS" + ", " +
      "distributionType=UNIFORM" + ", " +
      "magnitudes=(0.0, )" + ", " +
      "name='T1'" + ", " +
      "region=mdb.models['model'].rootAssembly.instances['Instance A'].sets['A1']" +
      ")");

    s.Add("mdb.models['model'].Temperature(" +
      "createStepName='Initial'" + ", " +
      "crossSectionDistribution=CONSTANT_THROUGH_THICKNESS" + ", " +
      "distributionType=UNIFORM" + ", " +
      "magnitudes=(0.0, )" + ", " +
      "name='T2'" + ", " +
      "region=mdb.models['model'].rootAssembly.instances['Instance A'].sets['A2']" +
      ")"
      );

    return s.ToArray();
  }
  public string[] GetSteps()
  {
    List<string> s = new List<string>();

    double timePeriod = 1.0;
    double incrementInitial = 0.01;
    double incrementMin = 1e-6;
    double incrementMax = 0.05;



    var a1 = new double[4]{-50,-25,0,10};
    var a2 = new double[4]{-50,-25,0,10};

    var stepNames = new List<string>();
    stepNames.Add("Initial");

    // SHELL
    int stepCount = 1;
    for (int i = 0; i < a1.Length; i++)
    {
      for (int j = 0; j < a2.Length; j++)
      {
        s.Add(" ");
        s.Add("# STEP N : " + stepCount);
        s.Add("# STEP[i,j] : (" + i + "," + j + ")");
        s.Add("# A[i,j] : (" + a1[i] + "," + a2[j] + ")");

        string stepName = String.Format("({0},{1})", a1[i], a2[j]);
        stepNames.Add(stepName);

        s.Add(String.Format("mdb.models['model'].StaticStep(" +
          "nlgeom=ON" + ", " +
          "maxNumInc=200" + ", " +
          "initialInc={0}" + ", " +
          "maxInc={1}" + ", " +
          "minInc={2}" + ", " +
          "name='" + stepName + "'" + ", " +
          "previous='" + stepNames[stepCount - 1] + "'" +
          ")", incrementInitial, incrementMax, incrementMin)
          );

        s.Add(String.Format("mdb.models['model'].predefinedFields['T1'].setValuesInStep(" +
          "magnitudes=({0}, )" + ", " +
          "stepName='" + stepName + "')", a1[i])
          );

        s.Add(String.Format("mdb.models['model'].predefinedFields['T2'].setValuesInStep(" +
          "magnitudes=({0}, )" + ", " +
          "stepName='" + stepName + "')", a2[j])
          );

        stepCount++;
      }
    }
    return s.ToArray();
  }
  public string[] GetJob()
  {
    List<string> s = new List<string>();

    s.Add("mdb.Job(" +
      "atTime=None" + ", " +
      "contactPrint = OFF" + ", " +
      "description = ''" + ", " +
      "echoPrint = OFF" + ", " +
      "explicitPrecision = SINGLE" + ", " +
      "getMemoryFromAnalysis = True" + ", " +
      "historyPrint = OFF" + ", " +
      "memory = 90" + ", " +
      "memoryUnits = PERCENTAGE" + ", " +
      "model = 'model'" + ", " +
      "modelPrint = OFF" + ", " +
      "multiprocessingMode = DEFAULT" + ", " +
      "name = 'JOB'" + ", " +
      "nodalOutputPrecision = SINGLE" + ", " +
      "numCpus = 1" + ", " +
      "numGPUs = 0" + ", " +
      "queue = None" + ", " +
      "scratch = ''" + ", " +
      "type = ANALYSIS" + ", " +
      "userSubroutine = ''" + ", " +
      "waitHours = 0" + ", " +
      "waitMinutes = 0" +
      ")"
      );

    s.Add("mdb.jobs['JOB'].submit(consistencyChecking = OFF)");
    s.Add("mdb.jobs['JOB'].waitForCompletion()");
    return s.ToArray();
  }
  public string[] GetAbaqusFiles(string dir)
  {
    List<string> s = new List<string>();

    var path = dir + "\\" + "model.cae";
    s.Add("mdb.saveAs(pathName='" + path + "')");

    return s.ToArray();
  }
# ---------- end abaqus_py_file ----------
a2 = Panel(list_2)
bc = Panel(list_3)
panel_13 = Panel(abaqus_py_file.out)
c_script = CSharpScript(
    M=multiple_definition.M,
    A1=multiple_definition.A1,
    A2=multiple_definition.A2,
    BC=multiple_definition.BC,
    i=Slider(4, range=0..8))  # -> mesh, bc, a1, a2; inputs M: list of Mesh, A1: list, A2: list, BC: list, i: Int32
# ---------- c_script: C# ----------
    var b = ((int[]) BC[i]);

    var a1_tmp = (int[]) A1[i];
    var a2_tmp = (int[]) A2[i];

    var a1_0 = a1_tmp[0];
    var a1_1 = a1_tmp[1];
    var a2_0 = a2_tmp[0];
    var a2_1 = a2_tmp[1];

    a1 = new Line(M[i].Vertices[a1_0], M[i].Vertices[a1_1]);
    a2 = new Line(M[i].Vertices[a2_0], M[i].Vertices[a2_1]);


    mesh = M[i];
    bc = M[i].Vertices[b[0]];
# ---------- end c_script ----------

# ---- group: ACTUATOR
pt = Point(c_script.bc)
line = Line([c_script.a1, c_script.a2])
sph = Sphere(Base=pt, Radius=0.01)
line_2 = Line(line)
preview = CustomPreview(Geometry=[line_2, sph], Shader=ColourSwatch(SwatchColor=RGB(0, 0, 255)))

# ---- group: INFO
mesh = Mesh(c_script.mesh)
faceb = FaceBoundaries(Mesh=mesh)
facen = FaceNormals(Mesh=mesh)  # -> Centers, Normals
demesh = DeconstructMesh(Mesh=mesh)  # -> Vertices, Faces, Colours, Normals
lng_2 = ListLength(List=facen.Centers)
lng_3 = ListLength(List=demesh.Vertices)
deface = DeconstructFace(Face=demesh.Faces)  # -> CornerA, CornerB, CornerC, CornerD
series = Series(Start=1, Step=1, Count=lng_2)
series_2 = Series(Start=1, Step=1, Count=lng_3)
merge = Merge(Data1=graft(deface.CornerA), Data2=graft(deface.CornerB), Data3=graft(deface.CornerC), Data4=graft(deface.CornerD))  # -> simplify(Result)
int = Integer(series)
int_2 = Integer(series_2)
boundary = BoundarySurfaces(Edges=faceb)
face = TextTag(Location=facen.Centers, Text=int, Colour=ColourSwatch(SwatchColor=RGB(255, 255, 255)))
node_2 = TextTag(Location=demesh.Vertices, Text=int_2, Colour=ColourSwatch(SwatchColor=RGB(0, 0, 0)))
preview_2 = CustomPreview(Geometry=mesh, Shader=ColourSwatch(SwatchColor=RGBA(0, 0, 0, 49)))
