# Grasshopper definition TEST - grid and node class.gh (Grasshopper 0.9.76)
# plug-ins: Python Interpreter

python = PythonScript()  # -> out, a
# ---------- python: Python ----------
n = [5,4,3]

def DoLoop():
    for i in range(n[2]):
        for j in range(n[1]):
            for k in range(n[0]):
                index = k + n[0] * j + n[0]*n[1] * i
                print "", index, " = (",k,",",j,",",i,")"
                


N = len(n)

def DoLoop(Ind):
    rank = N-len(Ind)
    if rank == 1:
        for k in range(n[0]):
            index = k + n[0] * Ind[0] + n[0]*n[1] * Ind[1]
            print "", index, " = (",k,",",Ind[0],",",Ind[1],")"
    else:
        for l in range(n[rank-1]):
            Ind_l = list(Ind)
            Ind_l.insert(0,l)
            DoLoop(Ind_l)

DoLoop([])
# ---------- end python ----------
c_script = CSharpScript()  # -> out, A
# ---------- c_script: C# ----------
    var X2D = new double[2][]{new double[3]{1,3,7}, new double[3]{2,4,6}};
    var grid2D = new Grid(X2D);

    Print("" + grid2D.Count);
    for (int i = 0; i < grid2D.Count; i++)
    {
      var tuple1 = grid2D.tuples[i];
      var index = grid2D.TupleToIndex(tuple1);
      var tuple2 = grid2D.IndexToTuple(index);
      Print("" + i + " = " + index + " | " +
        Grid.TupleToString(tuple1) + " = " + Grid.TupleToString(tuple1) + " | " +
        grid2D.nodes[i].ToString()
        );
    }
# ---------- c_script: C# additional code ----------
  public class Grid
  {
    private int dim;
    private int n;
    public double[][] range;
    public int[] rangeCount;
    public List<Node> nodes;
    public List<int[]> tuples;

    /// <summary>
    /// Number of N-nodes in the grid.
    /// </summary>
    public int Count
    {
      get { return n; }
      protected set { n = value; }
    }

    /// <summary>
    /// Grid dimension.
    /// </summary>
    public int Dim
    {
      get { return dim; }
      protected set { dim = value; }
    }

    /// <summary>
    /// Initialize a N-Grid of dimension D.
    /// </summary>
    /// <param name="X">
    /// X is a 2 dimensionnal array that gives for each dimension the discrete states to consider :
    ///
    ///     - X[0]      = [x{0}_0, x{0}_1, ..., x{0}_(N{0}-1)]
    ///     - X[1]      = [x{1}_0, x{1}_1, ..., x{1}_(N{1}-1)]
    ///     - ...       ...
    ///     - X[i]      = [x{i}_0, x{i}_1, ..., x{i}_(N{i}-1)]
    ///     - ...       ...
    ///     - X[D-1]    = [x{D-1}_0, x{D-1}_1, ..., x{D-1}_(N{D-1}-1)]
    ///
    /// Where N is the dimension of the N-Grid.
    /// X[i] = [x{i}_0, x{i}_1, ..., x{i}_(N{i}-1)] must be sorted in ascending order.
    /// </param>
    public Grid(double[][] X)
    {
      this.Dim = X.Length;

      this.range = new double[this.Dim][];
      this.rangeCount = new int[this.Dim];

      for (int d = 0; d < this.Dim; d++)
      {
        // deep copy of X values
        range[d] = X[d].ToArray();

        // enforce ascending order of elements
        Array.Sort<double>(range[d]);

        // number of values for each dimension
        rangeCount[d] = range[d].Length;
      }

      // Populate the grid with tuples and N-nodes
      Populate(ref X);

      this.n = tuples.Count;
    }

    /// <summary>
    ///
    /// combinatorial generation of grid nodes :
    ///
    /// n = 0
    /// node[n + 0]     = [x{0}_0       , x{1}_0        , ..., x{D-1}_0]
    /// node[n + 1]     = [x{0}_1       , x{1}_0        , ..., x{D-1}_0]
    /// ...             ...
    /// node[n + N1-1]  = [x{0}_(N1-1)  , x{1}_0        , ..., x{D-1}_0]
    ///
    /// n = N1 * 1
    /// node[n + 0]     = [x{0}_0       , x{1}_1        , ..., x{D-1}_0]
    /// node[n + 1]     = [x{0}_1       , x{1}_1        , ..., x{D-1}_0]
    /// ...             ...
    /// node[n + N1-1]  = [x{0}_(N1-1)  , x{1}_1        , ..., x{D-1}_0]
    ///
    /// n = N1 * 2
    /// node[n + 0]     = [x{0}_0       , x{1}_2        , ..., x{D-1}_0]
    /// node[n + 1]     = [x{0}_1       , x{1}_2        , ..., x{D-1}_0]
    /// ...             ...
    /// node[n + N-1]  = [x{0}_(N1-1)  , x{1}_2         , ..., x{D-1}_0]
    ///
    /// ...
    ///
    /// n = N1 * (N2-1)
    /// node[n + 0]     = [x{0}_0       , x{1}_(N2-1)   , ..., x{D-1}_0]
    /// node[n + 1]     = [x{0}_1       , x{1}_(N2-1)   , ..., x{D-1}_0]
    /// ...             ...
    /// node[n + N1-1]  = [x{0}_(N1-1)  , x{1}_(N2-1)   , ..., x{D-1}_0]
    ///
    /// ...
    ///
    /// n = N1 * N2 * ... * N{D-1} x 1
    /// node[n + 0]     = [x{0}_0       , x{1}_0        , ..., x{D-1}_1]
    /// node[n + 1]     = [x{0}_1       , x{1}_0        , ..., x{D-1}_1]
    /// ...             ...
    /// node[n + N1-1]  = [x{0}_(N1-1)  , x{1}_0        , ..., x{D-1}_1]
    ///
    /// ...
    ///
    /// n = N1 * N2 * ... * (N{D-1}-1)
    /// node[n + 0]     = [x{0}_0       , x{1}_0        , ..., x{D-1}_(N{D}-1)]
    /// node[n + 1]     = [x{0}_1       , x{1}_0        , ..., x{D-1}_(N{D}-1)]
    /// ...             ...
    /// node[n + N1-1]  = [x{0}_(N1-1)  , x{1}_0        , ..., x{D-1}_(N{D}-1)]
    ///
    /// ...
    ///
    /// The nuplet  : [i{0}, i{1}, ..., i{D-1}]
    /// The node    : [x{0}[i{0}], x{1}[i{1}], ..., x{D-1}[i{D-1}]]
    /// Is at index : i{0} + N{0}*i{1} + N{0}*N{1}*i{2} + ... + N{0}*N{1}*..*N{D-2}*i{D-1}
    ///
    /// </summary>
    /// <param name="X"></param>
    private void Populate(ref double[][] X)
    {
      nodes = new List<Node>();
      tuples = new List<int[]>();
      DoTupleRecursion(this.rangeCount, new List<int>(), ref tuples, ref nodes, ref X);
    }
    private void DoTupleRecursion(int[] range, List<int> indices, ref List<int[]> tuples, ref List<Node> nodes, ref double[][]X)
    {
      int n = range.Length;
      int rank = n - indices.Count;

      if (rank == 1)
      {
        // compute base index
        int nk = 0;
        int nprod = 1;
        for (int i = 0; i < indices.Count; i++)
        {
          nprod *= range[i];
          nk += nprod * indices[i];
        }

        // append tuples
        for (int k = 0; k < range[0]; k++)
        {
          var index = k + nk;
          var tuple = new List<int>();
          tuple.Add(k);
          tuple.AddRange(indices);
          tuples.Add(tuple.ToArray());

          // do what-so ever with the given (index, tuple)
          var node = new Node(dim);
          for (int d = 0; d < tuple.Count; d++)
          {
            node[d] = X[d][tuple[d]];
          }
          nodes.Add(node);
        }
      }
      else
      {
        for (int l = 0; l < range[rank - 1]; l++)
        {
          var indices_l = indices.ToList<int>();
          indices_l.Insert(0, l);
          DoTupleRecursion(range, indices_l, ref tuples, ref nodes, ref X);
        }
      }
    }

    /// <summary>
    /// String representation of a tuple.
    /// </summary>
    /// <param name="tuple">The tuple.</param>
    /// <returns>A string representing the tuple (i0,i1,...,in-1).</returns>
    public static string TupleToString(IList<int> tuple)
    {
      var s = "(" + tuple[0];
      for (int i = 1; i < tuple.Count; i++)
      {
        s += ", " + tuple[i];
      }
      return s += ")";
    }

    /// <summary>
    /// Contigous index for tuples.
    /// </summary>
    /// <param name="tuple">The tuple.</param>
    /// <param name="range">The array of range int.</param>
    /// <returns>The tuple corresponding to the given index.</returns>
    public static int TupleToIndex(IList<int> tuple, IList<int> range)
    {
      int index = tuple[0];
      int nprod = 1;
      for (int i = 0; i < tuple.Count - 1; i++)
      {
        nprod *= range[i];
        index += nprod * tuple[i + 1];
      }
      return index;
    }
    public int TupleToIndex(IList<int> tuple)
    {
      return TupleToIndex(tuple, this.rangeCount);
    }

    /// <summary>
    /// Get a tuple from its contiguous index.
    /// </summary>
    /// <param name="index">The index to convert.</param>
    /// <param name="range">The int array of range.</param>
    /// <returns>The tuple corresponding to the given index.</returns>
    public static IList<int> IndexToTuple(int index, IList<int> range)
    {
      int n = range.Count;
      var tuple = new int[n];

      int q = index;
      int r;
      for (int i = 0; i < n - 1; i++)
      {
        q = Math.DivRem(q, range[i], out r);
        tuple[i] = r;
      }
      tuple[n - 1] = q;
      return tuple;
    }
    public int[] IndexToTuple(int index)
    {
      return IndexToTuple(index, this.rangeCount).ToArray<int>();
    }
  }
  public class Node
  {
    private int dim;
    private double[] node;

    /// <summary>
    /// State dimension.
    /// </summary>
    public int Dim
    {
      get { return dim; }
      protected set { dim = value; }
    }

    /// <summary>
    /// State value as double[] of length Dim.
    /// </summary>
    public double[] Value
    {
      get { return node; }
      protected set {
        int dim = value.Length;
        if (dim != this.Dim)
        {
          throw new System.IndexOutOfRangeException("This NState is of dimension " + this.Dim + " but the given double array is of length " + dim + ".");
        }
        else
        {
          node = value;
        }
      }
    }

    /// <summary>
    /// State value for a particular dimension.
    /// Idem as calling Value[d].
    /// </summary>
    public double this[int d]
    {
      get {
        return node[d];
      }
      set
      {
        node[d] = value;
      }
    }

    /// <summary>
    /// Create a new NState with an actual state.
    /// </summary>
    /// <param name="state">The actual state.</param>
    public Node(double[] state)
    {
      this.Dim = state.Length;
      this.Value = state;
    }

    /// <summary>
    /// Create a new NState with an actual state of zeros.
    /// </summary>
    /// <param name="dim">The dimension of the state.</param>
    public Node(int dim) : this(new double[dim])
    {
    }

    public override string ToString()
    {
      var s = "(" + node[0];
      for (int i = 1; i < node.Length; i++)
      {
        s += ", " + node[i];
      }
      return s += ")";
    }

  }
# ---------- end c_script ----------
panel = Panel(c_script.out)
panel_2 = Panel(python.out)
