# Grasshopper definition TEST - grid auto param.gh (Grasshopper 0.9.76)
# plug-ins: IvyGh

txt = Text(["rh", "rw"])
panel = Panel(txt)
txt_2 = Text(["rh", "rw"])
panel_2 = Panel(txt_2)
num = Number(Tree({1}: [-2, 1, 2], {2}: [-7, 5, 3, 1]))
num_2 = Number(Tree({1}: [-2, 1, 2], {2}: [-7, 5, 3, 2]))
d0_rh = Slider(0, range=-2..2)
d1_rw = Slider(5, range=-7..5)
grid = CreateGrid(InputRange=num, Labels=panel)  # -> GridInfo, Grid
d0_rh_2 = Slider(-1.25, range=-2..2)
d1_rw_2 = Slider(4.7, range=-7..5)
grid_2 = CreateGrid(InputRange=num_2, Labels=panel_2)  # -> GridInfo, Grid
slider = GridSlider(grid=grid.Grid, D0=d0_rh, D1=d1_rw)  # -> Info, ActivePoint, ActiveCell, GridNodes
slider_2 = GridSlider(grid=grid_2.Grid, D0=d0_rh_2, D1=d1_rw_2)  # -> Info, ActivePoint, ActiveCell, GridNodes
panel_3 = Panel(grid.GridInfo)
normalize = Normalize(Grid=grid.Grid)  # -> Info, Grid
g1xg2 = CartesianProduct(FirstGrid=grid.Grid, SecondGrid=grid_2.Grid)  # -> Info, CartesianProduct
panel_4 = Panel(grid_2.GridInfo)
t1xt2 = CartesianProductOfTuples(FirstTuple=slider.ActivePoint, SecondTuple=slider_2.ActivePoint)
normalize_2 = Normalize(Grid=g1xg2.CartesianProduct)  # -> Info, Grid
point = PointOnGrid(Grid=g1xg2.CartesianProduct, PointCoordinates=t1xt2)  # -> PointCoordinates, CellNumber
panel_5 = Panel(normalize.Info)
