# Grasshopper definition TEST - lerp.gh (Grasshopper 0.9.76)
# plug-ins: IvyGh

md_slider = MDSlider(
    slider_value=Point(1, 0.6524390244, 0.5),
    SliderMode=0,
    x_domain=Domain(0, 1),
    y_domain=Domain(0, 1),
    z_domain=Domain(0, 1))
lerp = GHComponentLerpTest(Point=md_slider)  # -> Point, Field, Cell, Info
crv = Curve(lerp.Cell)
number_slider = Slider(0.149, range=0..1)
pdecon = Deconstruct(Point=lerp.Point)  # -> flatten(XComponent), flatten(YComponent), flatten(ZComponent)
pdecon_2 = Deconstruct(Point=lerp.Field)  # -> flatten(XComponent), flatten(YComponent), flatten(ZComponent)
multiplication = Multiplication(A=pdecon.ZComponent, B=number_slider)
multiplication_2 = Multiplication(A=pdecon_2.ZComponent, B=number_slider)
pt = ConstructPoint(XCoordinate=pdecon.XComponent, YCoordinate=pdecon.YComponent, ZCoordinate=multiplication)
pt_2 = ConstructPoint(XCoordinate=pdecon_2.XComponent, YCoordinate=pdecon_2.YComponent, ZCoordinate=multiplication_2)
