# Grasshopper definition TEST - shading device generation.gh (Grasshopper 0.9.76)

num = Number()
num_2 = Number()

l = Slider(0.6, range=0.1..0.8)
w = Slider(0.6, range=0..1)
h = Slider(0.25, range=0.1..0.8)

rw = Slider(0.5, range=0.1..2)
rh = Slider(0.25, range=0.1..2)

# ---- group: Number of Faces
u1 = Slider(6, range=4..20)
u2 = Slider(12, range=4..20)
V = Slider(12, range=4..20)

# ----
shading_device_definition = CSharpScript(w=w, l=l, h=h, rw=rw, rh=rh, U1=u1, U2=u2, V=V)  # -> out, M, BC, A1, A2; inputs w: Double, l: Double, h: Double, rw: Double, rh: Double, U1: Int32, U2: Int32, V: Int32
# ---------- shading_device_definition: C# ----------
    Mesh m;
    int[][] a;
    int[] b;

    var meshProp = new int[3]{U1,U2,V};
    ShadingDevice(w, l, h, rw, rh, meshProp, out m, out a, out b);

    var a1 = new Line(m.Vertices[a[0][0]], m.Vertices[a[0][1]]);
    var a2 = new Line(m.Vertices[a[1][0]], m.Vertices[a[1][1]]);
    var bc = m.Vertices[b[0]];

    M = m;
    BC = bc;
    A1 = a1;
    A2 = a2;
# ---------- shading_device_definition: C# additional code ----------
  public void ShadingDevice(double w, double l, double h, double rw, double rh, int[] meshProp, out Mesh mesh, out int[][] A, out int[] BC)
  {
    // U1, U2, V = number of FACES in each direction
    // U1+1, U2+1, V+1 => number of VERTICIES in each direction
    var U1 = meshProp[0];
    var U2 = meshProp[1];
    var V = meshProp[2];

    Surface s1, s2;
    GetSurfaces(w, l, h, rw, rh, out s1, out s2);
    var P1 = GetUVGrid(s1, U1 + 1, V + 1);
    var P2 = GetUVGrid(s2, U2 + 1, V + 1);
    mesh = GetUVGridMerge(P1, P2);

    // Actuator 1
    var a1_0 = 0;
    var a1_1 = V * ((U1 + 1) + (U2 + 1) - 1) + U1;
    var A1 = new int[2]{a1_0, a1_1};

    // Actuator 2
    var a2_0 = a1_1 - U1;
    var a2_1 = a1_0 + U1;
    var A2 = new int[2]{a2_0, a2_1};

    // Actuators array
    A = new int[2][]{A1,A2};

    // Boudary condition
    var bc = (V / 2) * ((U1 + 1) + (U2 + 1) - 1) + U1 / 2;
    BC = new int[1]{bc};
  }

  /// <summary>
  /// Define the two surfaces that build up a shading device.
  /// </summary>
  /// <param name="w"></param>
  /// <param name="l"></param>
  /// <param name="h"></param>
  /// <param name="rw"></param>
  /// <param name="rh"></param>
  /// <param name="S1"></param>
  /// <param name="S2"></param>
  /// <returns></returns>
  public void GetSurfaces(double w, double l, double h, double rw, double rh, out Surface S1, out Surface S2)
  {
    Point3d p0,p1,p2;

    var sweep = new Rhino.Geometry.SweepOneRail();

    // Create S1 cross section crv
    p0 = new Point3d(-w / 2, 0, 0);
    p1 = new Point3d(0, rw - Math.Sqrt(rw * rw - w * w / 4), 0);
    p2 = new Point3d(+w / 2, 0, 0);
    var cs1 = new Arc(p0, p1, p2);
    var cs2 = new Arc(p0, p1, p2);

    // Create S1 rail crv
    var alpha = Math.Asin(h / rh); // arc angle
    p0 = new Point3d(-w / 2, 0, 0);
    p1 = new Point3d(-w / 2, rh * (1 - Math.Cos(alpha / 2)), rh * Math.Sin(alpha / 2));
    p2 = new Point3d(-w / 2, rh * (1 - Math.Cos(alpha)), h);
    var r1 = new Arc(p0, p1, p2);

    // Create S1 by sweep
    S1 = sweep.PerformSweep(r1.ToNurbsCurve(), cs1.ToNurbsCurve())[0].Surfaces[0];

    // Create S2 cross section crv
    var axis = new Vector3d(1, 0, 0);
    var center = new Point3d(0, rh, 0);
    var xform = Transform.Rotation(-alpha, axis, center);
    cs2.Transform(xform);

    // Create S1 rail crv
    var dir = new Vector3d(0, 1, 0);
    var r2 = new Line(p2, p2 + l * dir);

    // Create S2 by sweep
    S2 = sweep.PerformSweep(r2.ToNurbsCurve(), cs2.ToNurbsCurve())[0].Surfaces[0];
  }

  /// <summary>
  /// Get a grid of points on a surface along U and V.
  /// </summary>
  /// <param name="S">Input surface.</param>
  /// <param name="nu">Number of points in U direction.</param>
  /// <param name="nv">Number of points un V direction.</param>
  /// <returns>A 2 dimensionnal array of points P[iv][iu] of dimension nu*nv.</returns>
  public Point3d[][] GetUVGrid(Surface S, int nu, int nv)
  {
    var Iu = S.Domain(0);
    var Iv = S.Domain(1);

    int index;
    double u,v,tu,tv;

    var pts = new Point3d[nv][];

    // Create a Grid of points
    for (int iv = 0; iv < nv; iv++)
    {
      pts[iv] = new Point3d[nu];
      tv = (double) iv / (nv - 1);
      v = (1 - tv) * Iv.T0 + tv * Iv.T1;
      for (int iu = 0; iu < nu; iu++)
      {
        index = iu + nu * iv;
        tu = (double) iu / (nu - 1);
        u = (1 - tu) * Iu.T0 + tu * Iu.T1;
        var pt = S.PointAt(u, v);
        pts[iv][iu] = pt;
      }
    }
    return pts;
  }

  /// <summary>
  /// Merge 2 compatible grids of points along their U dilmension.
  /// </summary>
  /// <param name="P1">The first grid of points of length nv x nu1.</param>
  /// <param name="P2">The second grid of points of length nv x nu2.</param>
  /// <returns>A mesh.</returns>
  public Mesh GetUVGridMerge(Point3d[][] P1, Point3d[][] P2)
  {
    Mesh mesh = new Mesh();
    //pts = new List<Point3d>();

    int nu1 = P1[0].Length;
    int nv1 = P1.Length;

    int nu2 = P2[0].Length;
    int nv2 = P2.Length;

    // Merge grid along u (nv1 = nv2)
    // remove the duplicates in line iu1 = nu1-1 | iu2 = 0
    int nv = nv1;
    int nu = nu1 + nu2 - 1;
    for (int iv = 0; iv < nv; iv++)
    {
      // Add P1 points
      for (int iu1 = 0; iu1 < nu1; iu1++)
      {
        //index = iu1 + nu * iv;
        mesh.Vertices.Add(P1[iv][iu1]);
        //pts.Add(P1[iv][iu1]);
      }

      // Add P2 points
      for (int iu2 = 1; iu2 < nu2; iu2++)
      {
        //index = (nu1 - 1) + (iu2 - 1) + nu * iv;
        mesh.Vertices.Add(P2[iv][iu2]);
        //pts.Add(P2[iv][iu2]);
      }
    }

    // create faces
    for (int iv = 0; iv < nv - 1; iv++)
    {
      for (int iu = 0; iu < nu - 1; iu++)
      {
        int A = iu + nu * iv;
        int B = A + 1;
        int C = iu + 1 + nu * (iv + 1);
        int D = C - 1;
        mesh.Faces.AddFace(A, B, C, D);
        Print(String.Format("({0},{1},{2},{3})", A, B, C, D));
      }
    }

    return mesh;
  }
# ---------- end shading_device_definition ----------
multiple_definition = CSharpScript(w=w, l=l, h=h, U1=u1, U2=u2, V=V, Reference="Z:\Public\GitHub\Ivy\src\IvyCore\bin\Release\IvyCore.dll")  # -> out, M, BC, A; inputs w: Double, l: Double, h: Double, U1: Int32, U2: Int32, V: Int32
# ---------- multiple_definition: C# ----------
    var range_rw = new double[3]{0.4, 0.5, 0.6};
    var range_rh = new double[3]{0.26, 0.28, 0.3};


    var data = new double[2][]{range_rw, range_rh};

    Grid topoGrid = new Grid(data);
    Print("" + topoGrid.NodeCount);

    var meshProp = new int[3]{U1,U2,V};

    Mesh m;
    int[][] a;
    int[] b;
    double rw, rh;

    var m_list = new List<Mesh>();
    var a_list = new List<int[][]>();
    var b_list = new List<int[]>();

    for (int i = 0; i < topoGrid.NodeCount; i++)
    {
      var topoNode = topoGrid.Nodes[i];
      rw = topoNode[0];
      rh = topoNode[1];
      Print(rw + "," + rh);

      ShadingDevice(w, l, h, rw, rh, meshProp, out m, out a, out b);


      var a1 = new Line(m.Vertices[a[0][0]], m.Vertices[a[0][1]]);
      var a2 = new Line(m.Vertices[a[1][0]], m.Vertices[a[1][1]]);
      var bc = m.Vertices[b[0]];

      m_list.Add(m);
      a_list.Add(a);
      b_list.Add(b);
    }

    M = m_list;
    BC = b_list;
    A = a_list;
# ---------- multiple_definition: C# additional code ----------
  public void ShadingDevice(double w, double l, double h, double rw, double rh, int[] meshProp, out Mesh mesh, out int[][] A, out int[] BC)
  {
    // U1, U2, V = number of FACES in each direction
    // U1+1, U2+1, V+1 => number of VERTICIES in each direction
    var U1 = meshProp[0];
    var U2 = meshProp[1];
    var V = meshProp[2];


    Surface s1, s2;
    GetSurfaces(w, l, h, rw, rh, out s1, out s2);

    var P1 = GetUVGrid(s1, U1 + 1, V + 1);
    var P2 = GetUVGrid(s2, U2 + 1, V + 1);
    mesh = GetUVGridMerge(P1, P2);

    /*
    Print("edede");
    mesh = new Mesh();
    A = new int[2][];
    BC = new int[1];
    return;
*/

    // Actuator 1
    var a1_0 = 0;
    var a1_1 = V * ((U1 + 1) + (U2 + 1) - 1) + U1;
    var A1 = new int[2]{a1_0, a1_1};

    // Actuator 2
    var a2_0 = a1_1 - U1;
    var a2_1 = a1_0 + U1;
    var A2 = new int[2]{a2_0, a2_1};

    // Actuators array
    A = new int[2][]{A1,A2};

    // Boudary condition
    var bc = (V / 2) * ((U1 + 1) + (U2 + 1) - 1) + U1 / 2;
    BC = new int[1]{bc};
  }

  /// <summary>
  /// Define the two surfaces that build up a shading device.
  /// </summary>
  /// <param name="w"></param>
  /// <param name="l"></param>
  /// <param name="h"></param>
  /// <param name="rw"></param>
  /// <param name="rh"></param>
  /// <param name="S1"></param>
  /// <param name="S2"></param>
  /// <returns></returns>
  public void GetSurfaces(double w, double l, double h, double rw, double rh, out Surface S1, out Surface S2)
  {
    Point3d p0,p1,p2;

    var sweep = new Rhino.Geometry.SweepOneRail();

    /*
    Print("sdsmdlksmlkd");
    S1 = new Surface();
    S2 = new Surface();
    return;
*/

    // Create S1 cross section crv
    p0 = new Point3d(-w / 2, 0, 0);
    p1 = new Point3d(0, rw - Math.Sqrt(rw * rw - w * w / 4), 0);
    p2 = new Point3d(+w / 2, 0, 0);
    var cs1 = new Arc(p0, p1, p2);
    var cs2 = new Arc(p0, p1, p2);

    // Create S1 rail crv
    var alpha = Math.Asin(h / rh); // arc angle
    p0 = new Point3d(-w / 2, 0, 0);
    p1 = new Point3d(-w / 2, rh * (1 - Math.Cos(alpha / 2)), rh * Math.Sin(alpha / 2));
    p2 = new Point3d(-w / 2, rh * (1 - Math.Cos(alpha)), h);
    var r1 = new Arc(p0, p1, p2);

    // Create S1 by sweep
    S1 = sweep.PerformSweep(r1.ToNurbsCurve(), cs1.ToNurbsCurve())[0].Surfaces[0];

    // Create S2 cross section crv
    var axis = new Vector3d(1, 0, 0);
    var center = new Point3d(0, rh, 0);
    var xform = Transform.Rotation(-alpha, axis, center);
    cs2.Transform(xform);

    // Create S1 rail crv
    var dir = new Vector3d(0, 1, 0);
    var r2 = new Line(p2, p2 + l * dir);

    // Create S2 by sweep
    S2 = sweep.PerformSweep(r2.ToNurbsCurve(), cs2.ToNurbsCurve())[0].Surfaces[0];
  }

  /// <summary>
  /// Get a grid of points on a surface along U and V.
  /// </summary>
  /// <param name="S">Input surface.</param>
  /// <param name="nu">Number of points in U direction.</param>
  /// <param name="nv">Number of points un V direction.</param>
  /// <returns>A 2 dimensionnal array of points P[iv][iu] of dimension nu*nv.</returns>
  public Point3d[][] GetUVGrid(Surface S, int nu, int nv)
  {
    var Iu = S.Domain(0);
    var Iv = S.Domain(1);

    int index;
    double u,v,tu,tv;

    var pts = new Point3d[nv][];

    // Create a Grid of points
    for (int iv = 0; iv < nv; iv++)
    {
      pts[iv] = new Point3d[nu];
      tv = (double) iv / (nv - 1);
      v = (1 - tv) * Iv.T0 + tv * Iv.T1;
      for (int iu = 0; iu < nu; iu++)
      {
        index = iu + nu * iv;
        tu = (double) iu / (nu - 1);
        u = (1 - tu) * Iu.T0 + tu * Iu.T1;
        var pt = S.PointAt(u, v);
        pts[iv][iu] = pt;
      }
    }
    return pts;
  }

  /// <summary>
  /// Merge 2 compatible grids of points along their U dilmension.
  /// </summary>
  /// <param name="P1">The first grid of points of length nv x nu1.</param>
  /// <param name="P2">The second grid of points of length nv x nu2.</param>
  /// <returns>A mesh.</returns>
  public Mesh GetUVGridMerge(Point3d[][] P1, Point3d[][] P2)
  {
    Mesh mesh = new Mesh();
    //pts = new List<Point3d>();

    int nu1 = P1[0].Length;
    int nv1 = P1.Length;

    int nu2 = P2[0].Length;
    int nv2 = P2.Length;

    // Merge grid along u (nv1 = nv2)
    // remove the duplicates in line iu1 = nu1-1 | iu2 = 0
    int nv = nv1;
    int nu = nu1 + nu2 - 1;
    for (int iv = 0; iv < nv; iv++)
    {
      // Add P1 points
      for (int iu1 = 0; iu1 < nu1; iu1++)
      {
        //index = iu1 + nu * iv;
        mesh.Vertices.Add(P1[iv][iu1]);
        //pts.Add(P1[iv][iu1]);
      }

      // Add P2 points
      for (int iu2 = 1; iu2 < nu2; iu2++)
      {
        //index = (nu1 - 1) + (iu2 - 1) + nu * iv;
        mesh.Vertices.Add(P2[iv][iu2]);
        //pts.Add(P2[iv][iu2]);
      }
    }

    // create faces
    for (int iv = 0; iv < nv - 1; iv++)
    {
      for (int iu = 0; iu < nu - 1; iu++)
      {
        int A = iu + nu * iv;
        int B = A + 1;
        int C = iu + 1 + nu * (iv + 1);
        int D = C - 1;
        mesh.Faces.AddFace(A, B, C, D);
        //Print(String.Format("({0},{1},{2},{3})", A, B, C, D));
      }
    }

    return mesh;
  }
# ---------- end multiple_definition ----------
mesh = Mesh(multiple_definition.M)
mesh_2 = Mesh(shading_device_definition.M)
pt = Point(shading_device_definition.BC)
line = Line([shading_device_definition.A1, shading_device_definition.A2])
panel = Panel(multiple_definition.out)

# ---- group: INFO
mesh_3 = Mesh(mesh_2)
faceb = FaceBoundaries(Mesh=mesh_3)
facen = FaceNormals(Mesh=mesh_3)  # -> Centers, Normals
demesh = DeconstructMesh(Mesh=mesh_3)  # -> Vertices, Faces, Colours, Normals
lng = ListLength(List=facen.Centers)
lng_2 = ListLength(List=demesh.Vertices)
deface = DeconstructFace(Face=demesh.Faces)  # -> CornerA, CornerB, CornerC, CornerD
series = Series(Start=1, Step=1, Count=lng)
series_2 = Series(Start=1, Step=1, Count=lng_2)
merge = Merge(Data1=graft(deface.CornerA), Data2=graft(deface.CornerB), Data3=graft(deface.CornerC), Data4=graft(deface.CornerD))  # -> simplify(Result)
int = Integer(series)
int_2 = Integer(series_2)
boundary = BoundarySurfaces(Edges=faceb)
face = TextTag(Location=facen.Centers, Text=int, Colour=ColourSwatch(SwatchColor=RGB(255, 255, 255)))
node = TextTag(Location=demesh.Vertices, Text=int_2, Colour=ColourSwatch(SwatchColor=RGB(0, 0, 0)))
preview = CustomPreview(Geometry=mesh_3, Shader=ColourSwatch(SwatchColor=RGBA(0, 0, 0, 49)))

# ---- group: ACTUATOR
sph = Sphere(Base=pt, Radius=0.01)
line_2 = Line(line)
preview_2 = CustomPreview(Geometry=[line_2, sph], Shader=ColourSwatch(SwatchColor=RGB(0, 0, 255)))

# ----
num_3 = Number("1e-3")
lng_3 = ListLength(List=demesh.Faces)
repeat = RepeatData(Data=num_3, Length=lng_3)
faces = Integer(merge)
vertices = Point(demesh.Vertices)
txt = Text("""GRID (dim = 3 | nodeCount = 24
==========================
D1 = (1, 2)
D2 = (-15, -4, 2, 10)
D3 = (5, 6, 7)

==========================
1 = (0, 0, 0) | (1, -15, 5)
2 = (1, 0, 0) | (2, -15, 5)
3 = (0, 1, 0) | (1, -4, 5)
4 = (1, 1, 0) | (2, -4, 5)
5 = (0, 2, 0) | (1, 2, 5)
6 = (1, 2, 0) | (2, 2, 5)
7 = (0, 3, 0) | (1, 10, 5)
8 = (1, 3, 0) | (2, 10, 5)
9 = (0, 0, 1) | (1, -15, 6)
10 = (1, 0, 1) | (2, -15, 6)
11 = (0, 1, 1) | (1, -4, 6)
12 = (1, 1, 1) | (2, -4, 6)
13 = (0, 2, 1) | (1, 2, 6)
14 = (1, 2, 1) | (2, 2, 6)
15 = (0, 3, 1) | (1, 10, 6)
16 = (1, 3, 1) | (2, 10, 6)
17 = (0, 0, 2) | (1, -15, 7)
18 = (1, 0, 2) | (2, -15, 7)
19 = (0, 1, 2) | (1, -4, 7)
20 = (1, 1, 2) | (2, -4, 7)
21 = (0, 2, 2) | (1, 2, 7)
22 = (1, 2, 2) | (2, 2, 7)
23 = (0, 3, 2) | (1, 10, 7)
24 = (1, 3, 2) | (2, 10, 7)""")
panel_2 = Panel(txt)
lanch = Button()
