# Grasshopper definition GH - problem builder.gh (Grasshopper 0.9.76)
# plug-ins: ShadingDevice, IvyGh

# ---- group: Number of Faces
u1 = Slider(6, range=4..20)
u2 = Slider(12, range=4..20)
V = Slider(10, range=4..20)

# ----
w = Slider(0.6, range=0..1)
l = Slider(0.6, range=0.1..0.8)
h = Slider(0.25, range=0.1..0.8)

r = Number(Tree({1}: [0.5, 0.4, 0.6], {2}: [0.26, 0.28, 0.3]))
txt = Text(["rw", "rh"])
panel = Panel(r)
panel_2 = Panel(txt)
grid = CreateGrid(InputRange=panel, Labels=panel_2)  # -> GridInfo, Grid
panel_3 = Panel(grid.GridInfo)

# ----
# Build a shape for each shape parametric node
multiple_definition = CSharpScript(
    grid_topo=grid.Grid,
    w=w,
    l=l,
    h=h,
    U1=u1,
    U2=u2,
    V=V,
    Reference="Z:\Public\GitHub\Ivy\src\IvyCore\bin\Debug\IvyCore.dll")  # -> out, N, M, A1, A2, BC; inputs w: Double, l: Double, h: Double, U1: Int32, U2: Int32, V: Int32
# ---------- multiple_definition: C# ----------
    var topoGrid = (Grid) grid_topo;

    //var range_rw = new double[3]{0.4, 0.5, 0.6};
    //var range_rh = new double[3]{0.26, 0.28, 0.3};


    //var data = new double[2][]{range_rw, range_rh};

    //Grid topoGrid = new Grid(data);
    Print("" + topoGrid.NodeCount);

    var meshProp = new int[3]{U1,U2,V};

    Mesh m;
    int[][] a;
    int[] b;
    double rw, rh;

    var n_list = new List<Node>();
    var m_list = new List<Mesh>();
    var a1_list = new List<int[]>();
    var a2_list = new List<int[]>();
    var bc_list = new List<int[]>();

    for (int i = 0; i < topoGrid.NodeCount; i++)
    {
      var topoNode = topoGrid.Nodes[i];
      rw = topoNode[0];
      rh = topoNode[1];
      Print(rw + "," + rh);

      ShadingDevice(w, l, h, rw, rh, meshProp, out m, out a, out b);


      var a1 = new Line(m.Vertices[a[0][0]], m.Vertices[a[0][1]]);
      var a2 = new Line(m.Vertices[a[1][0]], m.Vertices[a[1][1]]);
      var bc = m.Vertices[b[0]];

      n_list.Add(topoNode);
      m_list.Add(m);
      a1_list.Add(a[0]);
      a2_list.Add(a[1]);
      bc_list.Add(b);
    }

    N = n_list;
    M = m_list;
    A1 = a1_list;
    A2 = a2_list;
    BC = bc_list;
# ---------- multiple_definition: C# additional code ----------
  public void ShadingDevice(double w, double l, double h, double rw, double rh, int[] meshProp, out Mesh mesh, out int[][] A, out int[] BC)
  {
    // U1, U2, V = number of FACES in each direction
    // U1+1, U2+1, V+1 => number of VERTICIES in each direction
    var U1 = meshProp[0];
    var U2 = meshProp[1];
    var V = meshProp[2];


    Surface s1, s2;
    GetSurfaces(w, l, h, rw, rh, out s1, out s2);

    var P1 = GetUVGrid(s1, U1 + 1, V + 1);
    var P2 = GetUVGrid(s2, U2 + 1, V + 1);
    mesh = GetUVGridMerge(P1, P2);

    /*
    Print("edede");
    mesh = new Mesh();
    A = new int[2][];
    BC = new int[1];
    return;
*/

    // Actuator 1
    var a1_0 = 0;
    var a1_1 = V * ((U1 + 1) + (U2 + 1) - 1) + U1;
    var A1 = new int[2]{a1_0, a1_1};

    // Actuator 2
    var a2_0 = a1_1 - U1;
    var a2_1 = a1_0 + U1;
    var A2 = new int[2]{a2_0, a2_1};

    // Actuators array
    A = new int[2][]{A1,A2};

    // Boudary condition
    var bc = (V / 2) * ((U1 + 1) + (U2 + 1) - 1) + U1 / 2;
    BC = new int[1]{bc};
  }

  /// <summary>
  /// Define the two surfaces that build up a shading device.
  /// </summary>
  /// <param name="w"></param>
  /// <param name="l"></param>
  /// <param name="h"></param>
  /// <param name="rw"></param>
  /// <param name="rh"></param>
  /// <param name="S1"></param>
  /// <param name="S2"></param>
  /// <returns></returns>
  public void GetSurfaces(double w, double l, double h, double rw, double rh, out Surface S1, out Surface S2)
  {
    Point3d p0,p1,p2;

    var sweep = new Rhino.Geometry.SweepOneRail();

    /*
    Print("sdsmdlksmlkd");
    S1 = new Surface();
    S2 = new Surface();
    return;
*/

    // Create S1 cross section crv
    p0 = new Point3d(-w / 2, 0, 0);
    p1 = new Point3d(0, rw - Math.Sqrt(rw * rw - w * w / 4), 0);
    p2 = new Point3d(+w / 2, 0, 0);
    var cs1 = new Arc(p0, p1, p2);
    var cs2 = new Arc(p0, p1, p2);

    // Create S1 rail crv
    var alpha = Math.Asin(h / rh); // arc angle
    p0 = new Point3d(-w / 2, 0, 0);
    p1 = new Point3d(-w / 2, rh * (1 - Math.Cos(alpha / 2)), rh * Math.Sin(alpha / 2));
    p2 = new Point3d(-w / 2, rh * (1 - Math.Cos(alpha)), h);
    var r1 = new Arc(p0, p1, p2);

    // Create S1 by sweep
    S1 = sweep.PerformSweep(r1.ToNurbsCurve(), cs1.ToNurbsCurve())[0].Surfaces[0];

    // Create S2 cross section crv
    var axis = new Vector3d(1, 0, 0);
    var center = new Point3d(0, rh, 0);
    var xform = Transform.Rotation(-alpha, axis, center);
    cs2.Transform(xform);

    // Create S1 rail crv
    var dir = new Vector3d(0, 1, 0);
    var r2 = new Line(p2, p2 + l * dir);

    // Create S2 by sweep
    S2 = sweep.PerformSweep(r2.ToNurbsCurve(), cs2.ToNurbsCurve())[0].Surfaces[0];
  }

  /// <summary>
  /// Get a grid of points on a surface along U and V.
  /// </summary>
  /// <param name="S">Input surface.</param>
  /// <param name="nu">Number of points in U direction.</param>
  /// <param name="nv">Number of points un V direction.</param>
  /// <returns>A 2 dimensionnal array of points P[iv][iu] of dimension nu*nv.</returns>
  public Point3d[][] GetUVGrid(Surface S, int nu, int nv)
  {
    var Iu = S.Domain(0);
    var Iv = S.Domain(1);

    int index;
    double u,v,tu,tv;

    var pts = new Point3d[nv][];

    // Create a Grid of points
    for (int iv = 0; iv < nv; iv++)
    {
      pts[iv] = new Point3d[nu];
      tv = (double) iv / (nv - 1);
      v = (1 - tv) * Iv.T0 + tv * Iv.T1;
      for (int iu = 0; iu < nu; iu++)
      {
        index = iu + nu * iv;
        tu = (double) iu / (nu - 1);
        u = (1 - tu) * Iu.T0 + tu * Iu.T1;
        var pt = S.PointAt(u, v);
        pts[iv][iu] = pt;
      }
    }
    return pts;
  }

  /// <summary>
  /// Merge 2 compatible grids of points along their U dilmension.
  /// </summary>
  /// <param name="P1">The first grid of points of length nv x nu1.</param>
  /// <param name="P2">The second grid of points of length nv x nu2.</param>
  /// <returns>A mesh.</returns>
  public Mesh GetUVGridMerge(Point3d[][] P1, Point3d[][] P2)
  {
    Mesh mesh = new Mesh();
    //pts = new List<Point3d>();

    int nu1 = P1[0].Length;
    int nv1 = P1.Length;

    int nu2 = P2[0].Length;
    int nv2 = P2.Length;

    // Merge grid along u (nv1 = nv2)
    // remove the duplicates in line iu1 = nu1-1 | iu2 = 0
    int nv = nv1;
    int nu = nu1 + nu2 - 1;
    for (int iv = 0; iv < nv; iv++)
    {
      // Add P1 points
      for (int iu1 = 0; iu1 < nu1; iu1++)
      {
        //index = iu1 + nu * iv;
        mesh.Vertices.Add(P1[iv][iu1]);
        //pts.Add(P1[iv][iu1]);
      }

      // Add P2 points
      for (int iu2 = 1; iu2 < nu2; iu2++)
      {
        //index = (nu1 - 1) + (iu2 - 1) + nu * iv;
        mesh.Vertices.Add(P2[iv][iu2]);
        //pts.Add(P2[iv][iu2]);
      }
    }

    // create faces
    for (int iv = 0; iv < nv - 1; iv++)
    {
      for (int iu = 0; iu < nu - 1; iu++)
      {
        int A = iu + nu * iv;
        int B = A + 1;
        int C = iu + 1 + nu * (iv + 1);
        int D = C - 1;
        mesh.Faces.AddFace(A, B, C, D);
        //Print(String.Format("({0},{1},{2},{3})", A, B, C, D));
      }
    }

    return mesh;
  }
# ---------- end multiple_definition ----------
list = RunPythonScriptFile(
    list=multiple_definition.A1,
    TooltipTextOverride="Launch a structural analysis with gRIDshell",
    Reference="Z:\PUBLIC\GITHUB\IVY\SRC\IVYCORE\BIN\DEBUG\IvyCore.dll")  # -> simplify(res)
# ---------- list: Python ----------
    res = (int[]) list;
# ---------- end list ----------
list_2 = RunPythonScriptFile(
    list=multiple_definition.A2,
    TooltipTextOverride="Launch a structural analysis with gRIDshell",
    Reference="Z:\PUBLIC\GITHUB\IVY\SRC\IVYCORE\BIN\DEBUG\IvyCore.dll")  # -> simplify(res); same code as list
list_3 = RunPythonScriptFile(
    list=multiple_definition.BC,
    TooltipTextOverride="Launch a structural analysis with gRIDshell",
    Reference="Z:\PUBLIC\GITHUB\IVY\SRC\IVYCORE\BIN\DEBUG\IvyCore.dll")  # -> simplify(res); same code as list
a1 = Panel(list)
a2 = Panel(list_2)
bc = Panel(list_3)
c_script = CSharpScript(
    M=multiple_definition.M,
    A1=multiple_definition.A1,
    A2=multiple_definition.A2,
    BC=multiple_definition.BC,
    i=Slider(4, range=0..8))  # -> mesh, bc, a1, a2; inputs M: list of Mesh, A1: list, A2: list, BC: list, i: Int32
# ---------- c_script: C# ----------
    var b = ((int[]) BC[i]);

    var a1_tmp = (int[]) A1[i];
    var a2_tmp = (int[]) A2[i];

    var a1_0 = a1_tmp[0];
    var a1_1 = a1_tmp[1];
    var a2_0 = a2_tmp[0];
    var a2_1 = a2_tmp[1];

    a1 = new Line(M[i].Vertices[a1_0], M[i].Vertices[a1_1]);
    a2 = new Line(M[i].Vertices[a2_0], M[i].Vertices[a2_1]);


    mesh = M[i];
    bc = M[i].Vertices[b[0]];
# ---------- end c_script ----------

# ---- group: ACTUATOR
pt = Point(c_script.bc)
line = Line([c_script.a1, c_script.a2])
sph = Sphere(Base=pt, Radius=0.01)
line_2 = Line(line)
preview = CustomPreview(Geometry=[line_2, sph], Shader=ColourSwatch(SwatchColor=RGB(0, 0, 255)))

# ---- group: INFO
mesh = Mesh(c_script.mesh)
faceb = FaceBoundaries(Mesh=mesh)
facen = FaceNormals(Mesh=mesh)  # -> Centers, Normals
demesh = DeconstructMesh(Mesh=mesh)  # -> Vertices, Faces, Colours, Normals
lng = ListLength(List=facen.Centers)
lng_2 = ListLength(List=demesh.Vertices)
deface = DeconstructFace(Face=demesh.Faces)  # -> CornerA, CornerB, CornerC, CornerD
series = Series(Start=1, Step=1, Count=lng)
series_2 = Series(Start=1, Step=1, Count=lng_2)
merge = Merge(Data1=graft(deface.CornerA), Data2=graft(deface.CornerB), Data3=graft(deface.CornerC), Data4=graft(deface.CornerD))  # -> simplify(Result)
int = Integer(series)
int_2 = Integer(series_2)
boundary = BoundarySurfaces(Edges=faceb)
face = TextTag(Location=facen.Centers, Text=int, Colour=ColourSwatch(SwatchColor=RGB(255, 255, 255)))
node = TextTag(Location=demesh.Vertices, Text=int_2, Colour=ColourSwatch(SwatchColor=RGB(0, 0, 0)))
preview_2 = CustomPreview(Geometry=mesh, Shader=ColourSwatch(SwatchColor=RGBA(0, 0, 0, 49)))

# ----
A = Number(Tree({1}: [-50, -25, 0, 25], {2}: [-50, -25, 0, 25]))
txt_2 = Text(["A1", "A2"])
panel_4 = Panel(A)
panel_5 = Panel(txt_2)
grid_2 = CreateGrid(InputRange=panel_4, Labels=panel_5)  # -> GridInfo, Grid

# ----
# Build Abaqus .INP and .PY Files
workingdir = FilePath("C:\Users\Lionel\Documents\Abaqus\WorkingDir\")
panel_6 = Panel(workingdir)
node_2 = Node(multiple_definition.N)
builder = AbaqusBuilder(
    WorkingDirectory=workingdir,
    ShapeGrid=grid.Grid,
    ActuationGrid=grid_2.Grid,
    Node=node_2,
    ShellMesh=multiple_definition.M,
    FirstActuator=list,
    SecondActuator=list_2,
    BoundaryCondition=list_3,
    Launch=Button())
panel_7 = Panel(builder)

# ----
# Use this component to launch python scripts for Abaqus
# directly from Grasshopper.
with_gui = BooleanToggle(False)
workingdir_2 = FilePath(workingdir)
abaqus_exe = FilePath("C:\SIMULIA\Abaqus\6.12-1\code\bin\abq6121.exe")
panel_8 = Panel(workingdir_2)

lanch = Button()
concat = Concatenate(FragmentA=workingdir_2, FragmentB="model_run.py")
run_script = RunPythonScriptFile(
    path_to_py=concat,
    path_to_exe=abaqus_exe,
    GUI=with_gui,
    launch=lanch,
    TooltipTextOverride="Launch a structural analysis with gRIDshell")  # -> out, res; inputs GUI: Boolean, launch: Boolean
# ---------- run_script: Python ----------
    string dir = System.IO.Path.GetDirectoryName(path_to_py.ToString());
    string filename = System.IO.Path.GetFileName(path_to_py.ToString());

    Print("ABAQUS EXE : " + path_to_exe);
    Print("SCRIPT DIR : " + dir);
    Print("SCRIPT FILE : " + filename);
  
    if(launch == true)
    {
      System.Diagnostics.Process p;

      using (p = new System.Diagnostics.Process())
      {
        p.StartInfo.FileName = path_to_exe.ToString();
        p.StartInfo.WorkingDirectory = dir + "\\";
        p.StartInfo.UseShellExecute = false;
        //p.StartInfo.RedirectStandardOutput = true;
        //p.StartInfo.RedirectStandardInput = true;
        //p.StartInfo.RedirectStandardError = true;

        if (GUI)
        {
          p.StartInfo.Arguments = @"cae script=" + filename;
        }
        else
        {
          p.StartInfo.Arguments = @"cae noGui=" + filename;
        }
        p.Start();
        p.WaitForExit();
      }
    }
    Print("PROCESS EXIT");
# ---------- end run_script ----------
panel_9 = Panel(run_script.out)

lanch_2 = Button()
concat_2 = Concatenate(FragmentA=workingdir_2, FragmentB="model_pre.py")
run_script_2 = RunPythonScriptFile(
    path_to_py=concat_2,
    path_to_exe=abaqus_exe,
    GUI=with_gui,
    launch=lanch_2,
    TooltipTextOverride="Launch a structural analysis with gRIDshell")  # -> out, res; inputs GUI: Boolean, launch: Boolean; same code as run_script
panel_10 = Panel(run_script_2.out)

lanch_3 = Button()
concat_3 = Concatenate(FragmentA=workingdir_2, FragmentB="model_odb.py")
run_script_3 = RunPythonScriptFile(
    path_to_py=concat_3,
    path_to_exe=abaqus_exe,
    GUI=with_gui,
    launch=lanch_3,
    TooltipTextOverride="Launch a structural analysis with gRIDshell")  # -> out, res; inputs GUI: Boolean, launch: Boolean; same code as run_script
panel_11 = Panel(run_script_3.out)

# ----
# Set-up the Parametric Space
d0_rw = ValueList({"0", "1", "2"}, selected="0")
d1_rh = ValueList({"0", "1", "2"}, selected="0")
d0_a1 = ValueList({"0", "1", "2", "3"}, selected="0")
d1_a2 = ValueList({"0", "1", "2", "3"}, selected="0")

slider = GridSlider(grid=grid.Grid, D0=d0_rw, D1=d1_rh)  # -> Info, ActivePoint, ActiveCell, GridNodes

slider_2 = GridSlider(grid=grid_2.Grid, D0=d0_a1, D1=d1_a2)  # -> Info, ActivePoint, ActiveCell, GridNodes
panel_12 = Panel(slider_2.Info)

g1xg2 = CartesianProduct(FirstGrid=grid.Grid, SecondGrid=grid_2.Grid)  # -> Info, CartesianProduct
t1xt2 = CartesianProductOfTuples(FirstTuple=slider.ActivePoint, SecondTuple=slider_2.ActivePoint)
point = PointOnGrid(Grid=g1xg2.CartesianProduct, PointCoordinates=t1xt2)  # -> PointCoordinates, CellNumber

normalize = Normalize(Grid=g1xg2.CartesianProduct)  # -> Info, Grid
panel_13 = Panel(g1xg2.Info)
panel_14 = Panel(normalize.Info)
