# Grasshopper definition GH - reader.gh (Grasshopper 0.9.76)
# plug-ins: ShadingDevice, IvyGh

# ----
# Read DataBase
path = FilePath("Z:\Public\Github\Ivy\doc\example\CaseStudy_01\data.db")
reader = DataBaseReader(DataBaseDirectory=path)  # -> Out, GlobalGrid, ActuationPartialGrid, ShapePartialGrid, ShellNode, ShellFace, Fields

info = GridInfo(Grid=reader.GlobalGrid)
panel = Panel(info)
d0_rw = ValueList({"0", "1", "2"}, selected="1")
d1_rh = ValueList({"0", "1", "2"}, selected="0")
d0_a1 = ValueList({"0", "1", "2", "3"}, selected="1")

# ----
# BROWSE PARAMETRIC NODES
# SELECT A NODAL CONFIGURATION
d1_a2 = ValueList({"0", "1", "2", "3"}, selected="2")
grid_act = Grid(reader.ActuationPartialGrid)
grid_shp = Grid(reader.ShapePartialGrid)

d1_a2_2 = ValueList({"0", "1", "2", "3"}, selected="0")
d0_a1_2 = Slider(-12.5, range=-50..25)
d1_a2_3 = Slider(-12.5, range=-50..25)
d2_rw = Slider(0.5, range=0.4..0.6)
d3_rh = Slider(0.28, range=0.26..0.3)

slider = GridSlider(grid=grid_shp, D0=d0_rw, D1=d1_rh)  # -> Info, ActivePoint, ActiveCell
shp_address = Integer([d0_rw, d1_rh])
node_index = NodeIndexFromAddress(Grid=grid_shp, Address=shp_address)
grid_node = GridNode(Grid=grid_shp, NodeIndex=node_index)
node_prop = NodeProperties(Node=grid_node)  # -> NodeIndex, Coordinates, NormalizedCoordinates, AddressTuple, NormalizedNodeAddress
int = Integer(expr("x+1", node_prop.NodeIndex))
shp_index = Panel(int)
split = SplitList(List=node_prop.Coordinates, Index=1)  # -> ListA, ListB
rw = Panel(split.ListA)
rh = Panel(split.ListB)

act_address = Integer([d0_a1, d1_a2_2])
slider_2 = GridSlider(grid=grid_act, D0=d0_a1, D1=d1_a2_2)  # -> Info, ActivePoint, ActiveCell
node_index_2 = NodeIndexFromAddress(Grid=grid_act, Address=act_address)
grid_node_2 = GridNode(Grid=grid_act, NodeIndex=node_index_2)
node_prop_2 = NodeProperties(Node=grid_node_2)  # -> NodeIndex, Coordinates, NormalizedCoordinates, AddressTuple, NormalizedNodeAddress
int_2 = Integer(expr("x+1", node_prop_2.NodeIndex))
act_index = Panel(int_2)
split_2 = SplitList(List=node_prop_2.Coordinates, Index=1)  # -> ListA, ListB
a1 = Panel(split_2.ListA)
a2 = Panel(split_2.ListB)

grid_glb = Grid(reader.GlobalGrid)
t1xt2 = CartesianProductOfTuples(FirstTuple=slider_2.ActivePoint, SecondTuple=slider.ActivePoint)
node_index_3 = NodeIndexFromAddress(Grid=grid_glb, Address=t1xt2)
int_3 = Integer(expr("x+1", node_index_3))
glb_index = Panel(int_3)

z_scale = Slider(1, range=0..3)

# ----
# PRECOMPUTE ALL MESHES
# FOR NODAL CONFIGURATION
all_configurations = CSharpScript(
    G=reader.GlobalGrid,
    Fields=reader.Fields,
    Nodes=reader.ShellNode,
    Faces=reader.ShellFace,
    Reference="Z:\PUBLIC\GITHUB\IVY\SRC\BIN\IvyCore.dll")  # -> out, M, DX, DY, DZ, D; inputs Fields: tree of Double, Nodes: list of Int32, Faces: tree of Int32
# ---------- all_configurations: C# ----------
    var grid_glb = (Grid) G;
    int numNodesGLB = grid_glb.NodeCount;

    int n = Nodes.Count;
    var mesh_list = new List<Mesh>();
    var dx_list = new List<float[]>();
    var dy_list = new List<float[]>();
    var dz_list = new List<float[]>();
    var d_list = new List<float[]>();

    // FOR EACH GLOBAL NODE
    for (int k = 0; k < numNodesGLB; k++)
    {
      var mesh = new Mesh();
      var dx = new float[n];
      var dy = new float[n];
      var dz = new float[n];
      var d = new float[n];

      // ADD VERTICES
      for (int i = 0; i < n; i++)
      {
        var path = new GH_Path(i, k);
        var fval = Fields.Branch(path);
        mesh.Vertices.Add(fval[0] + fval[3], fval[1] + fval[4], fval[2] + fval[5]);
        dx[i] = (float) fval[3];
        dy[i] = (float) fval[4];
        dz[i] = (float) fval[5];
        d[i] = (float) Math.Sqrt(fval[3] * fval[3] + fval[4] * fval[4] + fval[5] * fval[5]);
      }

      // ADD FACES
      for (int i = 0; i < Faces.BranchCount; i++)
      {
        var face = Faces.Branches[i];
        mesh.Faces.AddFace(face[0], face[1], face[2], face[3]);
      }

      dx_list.Add(dx);
      dy_list.Add(dy);
      dz_list.Add(dz);
      d_list.Add(d);
      mesh_list.Add(mesh);
    }

    M = mesh_list;
    DX = dx_list;
    DY = dy_list;
    DZ = dz_list;
    D = d_list;
# ---------- end all_configurations ----------
list = ValueList({"DX": 0, "DY": 1, "DZ": 2, "D": 3}, selected="D")
filter = StreamFilter(
    Gate=list,
    Stream0=all_configurations.DX,
    Stream1=all_configurations.DY,
    Stream2=all_configurations.DZ,
    Stream3=all_configurations.D)
c_script = CSharpScript(D=filter)  # -> min, max
# ---------- c_script: C# ----------
    var d = (float[]) D;

    var m = d[0];
    var M = d[0];

    for (int i = 1; i < d.Length; i++)
    {
      var val = d[i];
      if (val > M)
      {
        M = val;
      }
      else if (val < m)
      {
        m = val;
      }
    }

    min = m;
    max = M;
# ---------- end c_script ----------
c_script_2 = CSharpScript(D=filter)  # -> simplify(val)
# ---------- c_script_2: C# ----------
      val = (float[]) D;;
# ---------- end c_script_2 ----------

bnd = Bounds(Numbers=c_script.min)
bnd_2 = Bounds(Numbers=c_script.max)
dedomain = DeconstructDomain(Domain=bnd)  # -> Start, End
dedomain_2 = DeconstructDomain(Domain=bnd_2)  # -> Start, End

gradient = Gradient(
    LowerLimit=dedomain.Start,
    UpperLimit=dedomain_2.End,
    Parameter=c_script_2,
    stops=[0: RGB(0, 0, 255), 0.25: RGB(0, 255, 0), 0.5: RGB(255, 255, 0), 0.75: RGB(255, 128, 0), 1: RGB(255, 0, 0)])
c_script_3 = CSharpScript(mesh=all_configurations.M, color=simplify(gradient))  # -> out, A; inputs mesh: list of Mesh, color: tree of Color
# ---------- c_script_3: C# ----------
    for (int i = 0; i < mesh.Count; i++)
    {
      var colors = color.Branches[i];
      for (int j = 0; j < mesh[i].Vertices.Count; j++)
      {
        mesh[i].VertexColors.Add(colors[j]);
      }
    }
    A = mesh;
# ---------- end c_script_3 ----------
mesh = Mesh(c_script_3.A)

xy_scale = Slider(4, range=0..6)
c_script_4 = CSharpScript(
    grid_glb=reader.GlobalGrid,
    grid_act=reader.ActuationPartialGrid,
    grid_shp=reader.ShapePartialGrid,
    actIndex=node_prop_2.NodeIndex,
    Reference="Z:\Public\Github\Ivy\src\bin\IvyCore.dll")  # -> out, glbIndex, shpCoord; inputs actIndex: Int32
# ---------- c_script_4: C# ----------
    var glb = (Grid) grid_glb;
    var act = (Grid) grid_act;
    var shp = (Grid) grid_shp;

    var index = new List<int>();
    var coord = new DataTree<double>();

    var node_act = act.Nodes[actIndex];
    for (int i = 0; i < shp.NodeCount; i++)
    {
      var node_shp = shp.Nodes[i];
      var coord_shp = node_shp.Normalize();
      var address_glb = IAddress.CartesianProduct(node_act.Address.Value, node_shp.Address.Value);

      var index_glb = glb.NodeAddressToIndex(address_glb);

      coord.AddRange(coord_shp, new GH_Path(i));
      index.Add(index_glb);

      Print(index_glb + " : " + IAddress.ToString(address_glb));
    }

    glbIndex = index;
    shpCoord = coord;
# ---------- end c_script_4 ----------
int_4 = Integer(c_script_4.glbIndex)
item = ListItem(List=mesh, Index=int_4, Wrap=True)
shape_position = ShapePosition(scale=xy_scale, address=c_script_4.shpCoord)
move = Move(Geometry=item, Motion=shape_position)  # -> Geometry, Transform

# ----
# Interpolate Results
grid_glb_2 = Grid(reader.GlobalGrid)
slider_3 = GridSlider(grid=grid_glb_2, D0=d0_a1_2, D1=d1_a2_3, D2=d2_rw, D3=d3_rh)  # -> Info, ActivePoint, ActiveCell
lerp = LerpInterpolant(Grid=grid_glb_2, PointCoordinates=slider_3.ActivePoint)  # -> PointCoordinates, PointNormalizedCoordinates, CellNumber, LerpInterpolant
lerp_2 = FieldLerpInterpolation(Interpolants=lerp.LerpInterpolant, Fields=reader.Fields)  # -> simplify(InterpolatedFields)
split_3 = SplitList(List=lerp.PointNormalizedCoordinates, Index=2)  # -> ListA, ListB
shape_position_2 = ShapePosition(scale=xy_scale, address=split_3.ListB)
all_configurations_2 = CSharpScript(Fields=lerp_2, Nodes=reader.ShellNode, Faces=reader.ShellFace, Reference="Z:\PUBLIC\GITHUB\IVY\SRC\BIN\IvyCore.dll")  # -> out, M, DX, DY, DZ, D; inputs Fields: tree of Double, Nodes: list of Int32, Faces: tree of Int32
# ---------- all_configurations_2: C# ----------
    int n = Nodes.Count;
    var mesh = new Mesh();
    var dx = new float[n];
    var dy = new float[n];
    var dz = new float[n];
    var d = new float[n];

    // ADD VERTICES
    for (int i = 0; i < n; i++)
    {
      var fval = Fields.Branches[i];
      mesh.Vertices.Add(fval[0] + fval[3], fval[1] + fval[4], fval[2] + fval[5]);
      dx[i] = (float) fval[3];
      dy[i] = (float) fval[4];
      dz[i] = (float) fval[5];
      d[i] = (float) Math.Sqrt(fval[3] * fval[3] + fval[4] * fval[4] + fval[5] * fval[5]);
    }

    // ADD FACES
    for (int i = 0; i < Faces.BranchCount; i++)
    {
      var face = Faces.Branches[i];
      mesh.Faces.AddFace(face[0], face[1], face[2], face[3]);
    }

    M = mesh;
    DX = dx;
    DY = dy;
    DZ = dz;
    D = d;
# ---------- end all_configurations_2 ----------
filter_2 = StreamFilter(
    Gate=list,
    Stream0=all_configurations_2.DX,
    Stream1=all_configurations_2.DY,
    Stream2=all_configurations_2.DZ,
    Stream3=all_configurations_2.D)
move_2 = Move(Geometry=all_configurations_2.M, Motion=shape_position_2)  # -> Geometry, Transform
gradient_2 = Gradient(
    LowerLimit=dedomain.Start,
    UpperLimit=dedomain_2.End,
    Parameter=filter_2,
    stops=[0: RGB(0, 0, 255), 0.25: RGB(0, 255, 0), 0.5: RGB(255, 255, 0), 0.75: RGB(255, 128, 0), 1: RGB(255, 0, 0)])
c_script_5 = CSharpScript(mesh=move_2.Geometry, color=simplify(gradient_2))  # -> out, A; inputs mesh: list of Mesh, color: tree of Color; same code as c_script_3

# ----
# STACK RESULTS
grid_node_3 = GridNode(Grid=reader.GlobalGrid)
node_prop_3 = NodeProperties(Node=grid_node_3)  # -> NodeIndex, simplify(Coordinates), simplify(NormalizedCoordinates), simplify(AddressTuple), NormalizedNodeAddress

# ---- group: XY Coord
split_4 = SplitList(List=node_prop_3.NormalizedCoordinates, Index=2)  # -> simplify(ListA), simplify(ListB)
shape_position_3 = ShapePosition(scale=xy_scale, address=simplify(split_4.ListB))  # -> simplify(vec_2)

# ---- group: Z coord
split_5 = SplitList(List=node_prop_3.AddressTuple, Index=2)  # -> simplify(ListA), simplify(ListB)
node_index_4 = NodeIndexFromAddress(Grid=reader.ActuationPartialGrid, Address=split_5.ListA)  # -> flatten(Index)
multiplication = Multiplication(A=z_scale, B=node_index_4)
Z = UnitZ(Factor=multiplication)

# ----
addition = Addition(A=Z, B=shape_position_3)
move_3 = Move(Geometry=mesh, Motion=addition)  # -> Geometry, Transform

# ==== cluster ShapePosition
scale = ClusterInput()
address = ClusterInput()

scale_2 = Number(scale)
address_2 = Number(address)
item = ListItem(List=address_2, Index=0, Wrap=True)
item_2 = ListItem(List=address_2, Index=1, Wrap=True)
multiplication = Multiplication(A=item_2, B=scale_2)
multiplication_2 = Multiplication(A=item, B=scale_2)
Y = UnitY(Factor=multiplication)
X = UnitX(Factor=multiplication_2)
addition = Addition(A=X, B=Y)  # -> flatten(Result)
vec = Vector(addition)

vec_2 = ClusterOutput(vec)
