# Grasshopper definition GH - test lerp.gh (Grasshopper 0.9.76)
# plug-ins: IvyGh

num = Number(Tree({1}: [0.2, 0.4, 0.6, 0.8], {2}: [0.2, 0.4, 0.6, 0.8], {3}: [0.2, 0.4, 0.6, 0.8], {4}: [0, 0.5, 1]))
txt = Text(["X", "Y", "Z", "C"])
d3_c = Slider(1, range=0..1)
d0_x = Slider(0.8, range=0.2..0.8)
d1_y = Slider(0.58, range=0.2..0.8)
d2_z = Slider(0.8, range=0.2..0.8)
grid = CreateGrid(InputRange=num, Labels=txt)  # -> GridInfo, Grid
slider = GridSlider(grid=grid.Grid, D0=d0_x, D1=d1_y, D2=d2_z, D3=d3_c)  # -> Info, ActivePoint, ActiveCell
panel = Panel(grid.GridInfo)
grid_node = GridNode(Grid=grid.Grid)
lerp = LerpInterpolant(Grid=grid.Grid, PointCoordinates=slider.ActivePoint)  # -> PointCoordinates, PointNormalizedCoordinates, CellNumber, LerpInterpolant
node_prop = NodeProperties(Node=grid_node)  # -> NodeIndex, simplify(Coordinates), simplify(NormalizedCoordinates), AddressTuple
panel_2 = Panel(node_prop.NormalizedCoordinates)
num_2 = Number(lerp.PointNormalizedCoordinates)
num_3 = Number(node_prop.Coordinates)
num_4 = Number(node_prop.NormalizedCoordinates)
item = ListItem(List=num_2, Index=0, Wrap=True)
item_2 = ListItem(List=num_2, Index=1, Wrap=True)
item_3 = ListItem(List=num_2, Index=2, Wrap=True)
panel_3 = Panel(node_prop.Coordinates)
item_4 = ListItem(List=num_3, Index=0, Wrap=True)
lerp_2 = FieldLerpInterpolation(Interpolants=lerp.LerpInterpolant, Fields=flatten(item_4))
item_5 = ListItem(List=num_3, Index=1, Wrap=True)
lerp_3 = FieldLerpInterpolation(Interpolants=lerp.LerpInterpolant, Fields=flatten(item_5))
item_6 = ListItem(List=num_3, Index=2, Wrap=True)
lerp_4 = FieldLerpInterpolation(Interpolants=lerp.LerpInterpolant, Fields=flatten(item_6))
item_7 = ListItem(List=num_4, Index=0, Wrap=True)
item_8 = ListItem(List=num_4, Index=1, Wrap=True)
item_9 = ListItem(List=num_4, Index=2, Wrap=True)
vec = VectorXYZ(XComponent=item, YComponent=item_2, ZComponent=item_3)  # -> Vector, Length
box = CenterBox(Base=PlaneXY(0, 0, 0), X=lerp_2, Y=lerp_3, Z=lerp_4)
number_slider = Slider(14.2, range=0..100)
multiplication = Multiplication(A=vec.Vector, B=number_slider)
vec_2 = VectorXYZ(XComponent=item_7, YComponent=item_8, ZComponent=item_9)  # -> Vector, Length
item_10 = ListItem(List=num_3, Index=3, Wrap=True)
lerp_5 = FieldLerpInterpolation(Interpolants=lerp.LerpInterpolant, Fields=flatten(item_10))
multiplication_2 = Multiplication(A=255, B=lerp_5)
number_slider_2 = Slider(1, range=0..1)
rgb = ColourRGB(Alpha=255, Red=100, Green=100, Blue=multiplication_2)
move = Move(Geometry=box, Motion=multiplication)  # -> Geometry, Transform
multiplication_3 = Multiplication(A=vec_2.Vector, B=number_slider)  # -> simplify(Result)
box_2 = CenterBox(Base=PlaneXY(0, 0, 0), X=item_4, Y=item_5, Z=item_6)
preview = CustomPreview(Geometry=move.Geometry, Shader=rgb)
move_2 = Move(Geometry=box_2, Motion=multiplication_3)  # -> Geometry, Transform
multiplication_4 = Multiplication(A=255, B=item_10)
rgb_2 = ColourRGB(Alpha=255, Red=100, Green=100, Blue=multiplication_4)
preview_2 = CustomPreview(Geometry=move_2.Geometry, Shader=rgb_2)
